# Grasshopper definition wave.gh (Grasshopper 1.0.7)

number_slider = Slider(40, range=0..60)

series = Series(Start=0, Step=Slider(2.5, range=0..10), Count=Slider(5, range=0..10))
Z = UnitZ(Factor=series)
geo = Geometry(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)
move = Move(Geometry=geo, Motion=Z)  # -> Geometry, Transform

number_slider_2 = Slider(0, range=0..360)
area = Area(Geometry=move.Geometry)  # -> Area, Centroid
dist = Slider(2.8, range=0..10)

c_script = CSharpScript()  # -> out, A
# ---------- c_script: C# ----------
    A = WaveMotion(2, 1, 0.2, 200, 1);
# ---------- c_script: C# additional code ----------
  public DataTree<Point3d> WaveMotion(double amplitude, double frequency, double speed, double totalTime, double timeStep)
  {
    // Set up the list to store the output points for each iteration
    DataTree<Point3d> output = new DataTree<Point3d>();

    GH_Path pth = new  GH_Path(0);
    // Define the starting position and the distance between each object
    Point3d startingPos = new Point3d(0, 0, 0);
    double distance = 5;

    int count = 0;

    // Loop through the total time in increments of the time step and calculate the new positions for each iteration
    for (double t = 0; t <= totalTime; t += timeStep)
    {
      // Set up the list to store the output points for this iteration
      List<Point3d> iterationOutput = new List<Point3d>();

      // Loop through the three objects and calculate their new positions based on the wave pattern
      for (int i = 0; i < 3; i++)
      {
                double x = i * distance;
  
        double z = amplitude * Math.Sin(frequency * (x - speed * t));
//        Point3d newPos = startingPos + new Vector3d(x, 0, z);
           Point3d newPos = startingPos + new Vector3d(0, 0, z);
        iterationOutput.Add(newPos);
      }

      pth = new  GH_Path(count);

      // Add this iteration's output list to the main output list
      output.AddRange(iterationOutput, pth);

      count++;
    }

    // Return the list of output lists
    return output;
  }
# ---------- end c_script ----------
concat = Concatenate(FragmentA="{", FragmentB=Slider(58, range=0..100), FragmentC="}")
panel = Panel(c_script.out)
split = SplitTree(Data=c_script.A, Masks=flatten(concat))  # -> Positive, Negative

# ----
# In this script, the WaveMotion function takes four input parameters: the amplitude, frequency, and speed of the wave, and the current time t. The function then calculates the new positions of three objects arranged in a line, with the distance between each object set to distance. The new positions are calculated based on the equation z = A * sin(w * (x - v * t)), where A is the amplitude, w is the frequency, v is the speed, and t is the current time. The function then returns a list of Point3d objects representing the new positions of the three objects. You can connect this script to a Grasshopper component to visualize the output points.
number_slider_3 = Slider(8, range=0..10)
# This script is similar to the previous one, but it adds two new input parameters: totalTime, which is the total amount of time to simulate the wave motion, and timeStep, which is the time increment between each iteration. The script then loops through the total time in increments of the time step, and for each iteration, it calculates the new positions of the three objects based on the wave pattern, and saves the output to a list. Finally, it returns a list of lists, where each inner list contains the output points for one iteration.
# 
# To use this script in Grasshopper, you can create a new Script component, set its input parameters, and connect it to a List component to visualize the output. Here is an example Grasshopper definition that uses this script:
c_script_2 = CSharpScript(amplitude=number_slider_3)  # -> out, A; inputs amplitude: Double; disabled
# ---------- c_script_2: C# ----------
    A = WaveMotion(amplitude, 2, 0.5, 0.5);
# ---------- c_script_2: C# additional code ----------
  public List<Point3d> WaveMotion(double amplitude, double frequency, double speed, double t)
  {
    // Set up the list to store the output points
    List<Point3d> output = new List<Point3d>();

    // Define the starting position and the distance between each object
    Point3d startingPos = new Point3d(0, 0, 0);
    double distance = 5;

    // Loop through the three objects and calculate their new positions based on the wave pattern
    for (int i = 0; i < 3; i++)
    {
      double x = i * distance;
      double z = amplitude * Math.Sin(frequency * (x - speed * t));
      Point3d newPos = startingPos + new Vector3d(x, 0, z);
      output.Add(newPos);
    }

    // Return the list of output points
    return output;
  }
# ---------- end c_script_2 ----------

number_slider_4 = Slider(45, range=0..100)  # disabled
panel_2 = Panel("{")  # disabled
panel_3 = Panel("}")  # disabled
c_script_3 = CSharpScript()  # -> out, A; disabled
# ---------- c_script_3: C# ----------
    A = WaveMotion(2, 1, 0.2, 200, 1);
# ---------- c_script_3: C# additional code ----------
  public DataTree<Point3d> WaveMotion(double amplitude, double frequency, double speed, double totalTime, double timeStep)
  {
    // Set up the list to store the output points for each iteration
    DataTree<Point3d> output = new DataTree<Point3d>();

    GH_Path pth = new  GH_Path(0);
    // Define the starting position and the distance between each object
    Point3d startingPos = new Point3d(0, 0, 0);
    double distance = 5;

    int count = 0;

    // Loop through the total time in increments of the time step and calculate the new positions for each iteration
    for (double t = 0; t <= totalTime; t += timeStep)
    {
      // Set up the list to store the output points for this iteration
      List<Point3d> iterationOutput = new List<Point3d>();

      // Loop through the three objects and calculate their new positions based on the wave pattern
      for (int i = 0; i < 3; i++)
      {
        double x = i * distance;
        double z = amplitude * Math.Sin(frequency * (x - speed * t));
        Point3d newPos = startingPos + new Vector3d(x, 0, z);
        iterationOutput.Add(newPos);
      }

      pth = new  GH_Path(count);

      // Add this iteration's output list to the main output list
      output.AddRange(iterationOutput, pth);

      count++;

      //      pth = pth.Increment(1);
    }

    // Return the list of output lists
    return output;
  }
# ---------- end c_script_3 ----------
concat_2 = Concatenate(FragmentA=panel_2, FragmentB=number_slider_4, FragmentC=panel_3)  # disabled
panel_4 = Panel(c_script_3.out)  # disabled
split_2 = SplitTree(Data=c_script_3.A, Masks=flatten(concat_2))  # -> Positive, Negative; disabled

pl_origin = PlaneOrigin(Base=area.Centroid, Origin=area.Centroid)
c_script_4 = CSharpScript(
    geoms=pl_origin,
    center=pl_origin,
    distance=dist,
    amplitude=Slider(1.7, range=0..10),
    cycles=Slider(2, range=0..30),
    stepCount=Slider(60, range=0..1000))  # -> out, A; inputs geoms: list of Plane, center: list of Point3d, distance: Double, amplitude: Double, cycles: Int32, stepCount: Double
# ---------- c_script_4: C# ----------
    _geoms = geoms;
    _center = center;
    A = WaveMotion(distance, amplitude, cycles, stepCount);
# ---------- c_script_4: C# additional code ----------
  List<Plane> _geoms;
  List<Point3d> _center;

  public DataTree<Plane> WaveMotion(double distance, double amplitude, double speed, double stepCount)
  {
    double frequency = RhinoMath.ToRadians(360.00 / stepCount);

    // Set up the list to store the output points for each iteration
    DataTree<Plane> output = new DataTree<Plane>();

    GH_Path pth = new  GH_Path(0);
    // Define the starting position and the distance between each object
    Point3d startingPos = new Point3d(0, 0, 0);

    int count = 0;

    // Loop through the total time in increments of the time step and calculate the new positions for each iteration
    for (double t = 0; t <= stepCount; t++)
    {
      // Set up the list to store the output points for this iteration
      List<Plane> iterationOutput = new List<Plane>();

      // Loop through the three objects and calculate their new positions based on the wave pattern
      for (int i = 0; i < _geoms.Count; i++)
      {
        double x = i * distance;

        double z = amplitude * Math.Sin(frequency * (x - speed * t));
        double rot = Math.Sin(frequency * (x - speed * t)) / 6;




        Plane brp = _geoms[i];

        brp = new Plane(brp);

        brp.Translate(new Vector3d(09, 0, z));

        //        brp.GetBoundingBox(
        brp.Rotate(rot, brp.ZAxis, brp.Origin);

        iterationOutput.Add(brp);
      }

      pth = new  GH_Path(count);

      // Add this iteration's output list to the main output list
      output.AddRange(iterationOutput, pth);

      count++;
    }

    // Return the list of output lists
    return output;
  }
# ---------- end c_script_4 ----------
concat_3 = Concatenate(FragmentA="{", FragmentB=number_slider, FragmentC="}")
split_3 = SplitTree(Data=c_script_4.A, Masks=flatten(concat_3))  # -> flatten(Positive), Negative
number_slider_5 = Slider(10, range=0..25)
number_slider_6 = Slider(58, range=0..60)
panel_5 = Panel("25")
data = Data(number_slider)
series_2 = Series(Start=0, Step=1, Count=number_slider_5)
c_script_5 = CSharpScript(series=series_2, pause=Slider(10, range=0..10))  # -> out, Idxs, A, B; inputs series: list of Int32, pause: Int32
# ---------- c_script_5: C# ----------
    List < int> idxs = new List<int> ();
    List < string> txtA = new List<string> ();
    List < string> txtB = new List<string> ();

    int count = series.Count;

    AddToList(count, txtA, "Hallo");
    AddToList(count, txtB, "Hola");
    idxs.AddRange(series);
    AddPause(pause,  idxs, txtA,  txtB);

    AddToList(count, txtA, "Hola");
    AddToList(count, txtB, "Hello");
    idxs.AddRange(series);
      AddPause(pause,  idxs, txtA,  txtB);

    AddToList(count, txtA, "Hello");
    AddToList(count, txtB, "Hallo"); 
    idxs.AddRange(series);
  AddPause(pause,  idxs, txtA,  txtB);






    //Output

    Idxs = idxs;
    A = txtA;
    B = txtB;
# ---------- c_script_5: C# additional code ----------
  void AddToList(int count, List < string> lst, string txt)
  {
    for (int i = 0; i < count; i++)
    {
      lst.Add(txt);
    }
  }
  
  void AddPause(int count, List < int> idxs, List < string> txtA, List < string> txtB)
  {
    int c = idxs.Count - 1;
    
    string tA = txtA[c];
    string tB = txtB[c];
    int idx = idxs[c];
    
    for (int i = 0; i < count; i++)
    {
      txtA.Add(tA);
      txtB.Add(tB);
      idxs.Add(idx);
    }
  }
# ---------- end c_script_5 ----------
item = ListItem(List=c_script_5.B, Index=data, Wrap=True)
item_2 = ListItem(List=c_script_5.A, Index=data, Wrap=True)
item_3 = ListItem(List=c_script_5.Idxs, Index=data, Wrap=True)
c_script_6 = CSharpScript(reset=Button(), inputTxtA=item_2, inputTxtB=item, totalSteps=number_slider_5, step=item_3)  # -> out, A, B; inputs inputTxtA: String, inputTxtB: String, totalSteps: Int32, step: Int32
# ---------- c_script_6: C# usings ----------
using Rhino.Display;
# ---------- c_script_6: C# ----------
    _txtPln = Plane.WorldXY;
    _txtPln = FlipClockAnimation(inputTxtA, inputTxtB, step, totalSteps);

    // Output
    A = new Point3d(0, 0, 0);
# ---------- c_script_6: C# additional code ----------
  Plane _txtPln;
  string _txt;

  Plane FlipClockAnimation(string inputTxtA, string inputTxtB, int step, int totalSteps)
  {
    Point3d textPos = new Point3d(0, 0, -10);

    Vector3d cameraDir = RhinoDoc.ActiveDoc.Views.ActiveView.ActiveViewport.CameraDirection;

    RhinoViewport viewport = RhinoDoc.ActiveDoc.Views.ActiveView.ActiveViewport;

    Vector3d cameraUp = viewport.CameraUp;
    Vector3d cameraX = viewport.CameraX;

    double deg = 180.00 / totalSteps * step;

    if (deg >= 90)
    {
      cameraUp = -cameraUp;
      _txt = inputTxtB;
    }

    else
    {
      _txt = inputTxtA;
    }


    Plane textPlane = new Plane(textPos, cameraX, cameraUp);

    //    if(rad < 999 )
    textPlane.Rotate(RhinoMath.ToRadians(deg), textPlane.XAxis);



    return textPlane;
  }



  //Draw all meshes in this method.
  public override void DrawViewportMeshes(IGH_PreviewArgs args)
  {
    Text3d txt = new Text3d(_txt, _txtPln, 6);
    txt.VerticalAlignment = Rhino.DocObjects.TextVerticalAlignment.Middle;
    txt.HorizontalAlignment = Rhino.DocObjects.TextHorizontalAlignment.Center;
    txt.Bold = true;


    args.Display.Draw3dText(txt, System.Drawing.Color.Black);
  }
# ---------- end c_script_6 ----------

range = Range(Domain=Domain(0, 1), Steps=Slider(9, range=0..100))
crv = Curve(reparameterize(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))
crv_2 = Curve(reparameterize(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))
crv_3 = Curve(reparameterize(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))
crv_4 = Curve(reparameterize(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))
tweencrv = TweenCurve(CurveA=crv, CurveB=crv_2, Factor=range, BlendType=0)
tweencrv_2 = TweenCurve(CurveA=crv_2, CurveB=crv_3, Factor=range, BlendType=0)
tweencrv_3 = TweenCurve(CurveA=crv_3, CurveB=crv_4, Factor=range, BlendType=0)
merge = Merge(Data1=tweencrv, Data2=tweencrv_2, Data3=tweencrv_3)

panel_6 = Panel(c_script_6.out)
crv_5 = Curve(<curve referenced from the Rhino model>)
debox = DeconstructBox(Box=crv_5)  # -> Plane, X, Y, Z

area_2 = Area(Geometry=crv_2)  # -> Area, Centroid
item_4 = ListItem(List=split_3.Positive, Index=0, Wrap=True)
item_5 = ListItem(List=pl_origin, Index=0, Wrap=True)
vec2pt = Vector2Pt(PointA=item_4, PointB=item_5, Unitize=False)  # -> Vector, Length
item_6 = ListItem(List=merge, Index=number_slider, Wrap=True)
move_2 = Move(Geometry=split_3.Positive, Motion=vec2pt.Vector)  # -> Geometry, Transform
orient = Orient(Geometry=item_6, Source=area_2.Centroid, Target=simplify(graft(move_2.Geometry)))  # -> simplify(Geometry), Transform
offset = OffsetCurve(Curve=orient.Geometry, Distance=expr("-x", Slider(1, range=0..3)), Corners=0)  # -> simplify(Curve)
split_4 = SplitBrep(Brep=orient.Geometry, Cutter=offset)
offset_2 = OffsetCurve(Curve=orient.Geometry, Distance=Slider(0.15, range=0..1), Corners=1)
Z_2 = UnitZ(Factor=Slider(1.4, range=0..10))

pt = Point(<point referenced from the Rhino model>)
dedomain = DeconstructDomain(Domain=debox.X)  # -> Start, End
dedomain_2 = DeconstructDomain(Domain=debox.Y)  # -> Start, End
xy = XYPlane(Origin=pt)
subtraction = Subtraction(A=dedomain.End, B=dedomain.Start)
subtraction_2 = Subtraction(A=dedomain_2.End, B=dedomain_2.Start)
division = Division(A="1", B=subtraction)
division_2 = Division(A=Slider(0.78, range=0..1), B=subtraction_2)
scale_nu = ScaleNU(Geometry=crv_5, Plane=xy, ScaleX=division, ScaleY=division_2, ScaleZ=1)  # -> Geometry, Transform
move_3 = Move(Geometry=scale_nu.Geometry, Motion=expr("-x", pt))  # -> Geometry, Transform
cp = ControlPoints(Curve=move_3.Geometry)  # -> Points, Weights, Knots
srf = Surface(reparameterize(<surface referenced from the Rhino model>))
divide = DivideCurve(Curve=reparameterize(move_3.Geometry), Count=Slider(200, range=0..1000), Kinks=False)  # -> Points, Tangents, Parameters

item_7 = ListItem(List=split_4, Index=1, Wrap=True)
extr = Extrude(Base=item_7, Direction=Z_2)
preview = CustomPreview(Geometry=extr, Material=ColourSwatch(SwatchColor=RGB(255, 255, 255)))

pt_2 = ConstructPoint(XCoordinate=0, YCoordinate=Slider(1, range=0..1), ZCoordinate=0)
crvsrf = CurveOnSurface(Surface=srf, UVCoordinates=divide.Points, Closed=False)  # -> Curve, Length, Domain

# ----
# Brep
multiplication = Multiplication(A=number_slider, B=6)
edges = BrepEdges(Brep=offset_2)  # -> Naked, Interior, NonManifold
join = JoinCurves(Curves=edges.Naked, Preserve=True)
area_3 = Area(Geometry=join)  # -> Area, Centroid
series_3 = Series(Start=multiplication, Step=Slider(90, range=0..100), Count=Slider(5, range=0..10))  # -> simplify(graft(Series))
cyl = Cylinder(Base=area_3.Centroid, Radius=Slider(7, range=0..10), Length=Z_2)
extr_2 = Extrude(Base=join, Direction=Z_2)
rotate = Rotate(Geometry=simplify(cyl), Angle=simplify(degrees(series_3)), Plane=simplify(area_3.Centroid))  # -> Geometry, Transform
brep = Brep(extr_2)

iso = IsoCurve(Surface=srf, UVPoint=pt_2)  # -> UIsocurve, VIsocurve

crv_6 = Curve(<curve referenced from the Rhino model>)
debox_2 = DeconstructBox(Box=crv_6)  # -> Plane, X, Y, Z
dedomain_3 = DeconstructDomain(Domain=debox_2.X)  # -> Start, End
dedomain_4 = DeconstructDomain(Domain=debox_2.Y)  # -> Start, End
subtraction_3 = Subtraction(A=dedomain_3.End, B=dedomain_3.Start)
subtraction_4 = Subtraction(A=dedomain_4.End, B=dedomain_4.Start)
pt_3 = Point(<point referenced from the Rhino model>)
division_3 = Division(A="1", B=subtraction_3)
division_4 = Division(A=Slider(0.78, range=0..1), B=subtraction_4)
xy_2 = XYPlane(Origin=pt_3)
scale_nu_2 = ScaleNU(Geometry=crv_6, Plane=xy_2, ScaleX=division_3, ScaleY=division_4, ScaleZ=1)  # -> Geometry, Transform
move_4 = Move(Geometry=scale_nu_2.Geometry, Motion=expr("-x", pt_3))  # -> Geometry, Transform
cp_2 = ControlPoints(Curve=move_4.Geometry)  # -> Points, Weights, Knots
divide_2 = DivideCurve(Curve=reparameterize(move_4.Geometry), Count=Slider(200, range=0..1000), Kinks=False)  # -> Points, Tangents, Parameters

divide_3 = DivideCurve(Curve=iso.UIsocurve, Count=Slider(194, range=0..200), Kinks=False)  # -> Points, Tangents, Parameters
line = LineSDL(Start=divide_3.Points, Direction=Vector(0, 0, -1), Length=100)
ccx = CurveCurve(CurveA=crvsrf.Curve, CurveB=line)  # -> Points, ParamsA, ParamsB
shatter = Shatter(Curve=graft(line), Parameters=simplify(ccx.ParamsB))

srf_2 = Surface(reparameterize(rotate.Geometry))
pt_4 = ConstructPoint(XCoordinate=0, YCoordinate=Slider(1, range=0..1), ZCoordinate=0)
number_slider_7 = Slider(200, range=0..200)
iso_2 = IsoCurve(Surface=srf_2, UVPoint=pt_4)  # -> UIsocurve, VIsocurve
divide_4 = DivideCurve(Curve=iso_2.UIsocurve, Count=number_slider_7, Kinks=False)  # -> Points, Tangents, Parameters
line_2 = LineSDL(Start=divide_4.Points, Direction=Vector(0, 0, -1), Length=100)
crvsrf_2 = CurveOnSurface(Surface=srf_2, UVCoordinates=divide_2.Points, Closed=False)  # -> Curve, Length, Domain
ccx_2 = CurveCurve(CurveA=crvsrf_2.Curve, CurveB=line_2)  # -> Points, ParamsA, ParamsB
shatter_2 = Shatter(Curve=graft(line_2), Parameters=simplify(ccx_2.ParamsB))
item_8 = ListItem(List=shatter_2, Index=0, Wrap=True)  # -> simplify(Item)
end = EndPoints(Curve=item_8)  # -> Start, End

item_9 = ListItem(List=shatter, Index=0, Wrap=True)

path_mapper = PathMapper(end.Start, source="{a;b}", target="{a}")
move_5 = Move(Geometry=area_3.Centroid, Motion=Z_2)  # -> Geometry, Transform
repeat = RepeatData(Data=brep, Length=number_slider_7)  # -> simplify(graft(Data))
vec2pt_2 = Vector2Pt(PointA=simplify(path_mapper), PointB=simplify(move_5.Geometry), Unitize=False)  # -> graft(Vector), Length
move_6 = Move(Geometry=offset_2, Motion=Z_2)  # -> Geometry, Transform
project = Project(Curve=simplify(item_8), Brep=simplify(repeat), Direction=simplify(vec2pt_2.Vector))

project_2 = ProjectPoint(Point=end.End, Direction=vec2pt_2.Vector, Geometry=repeat)  # -> Point, Index
path_mapper_2 = PathMapper(project_2.Point, source="{a;b}", target="{a}")
intcrv = Interpolate(Vertices=path_mapper_2, Degree=3, Periodic=True, KnotStyle=1)  # -> Curve, Length, Domain

# ----
# Display
merge_2 = Merge(Data1=intcrv.Curve, Data2=project, Data3=move_6.Geometry)
pipe = Pipe(Curve=merge_2, Radius=Slider(0.03, range=0..0.1), Caps=0)
preview_2 = CustomPreview(Geometry=pipe, Material=ColourSwatch(SwatchColor=RGB(242, 157, 0)))
