# Grasshopper definition wave2.gh (Grasshopper 1.0.7)

# In this script, the WaveMotion function takes four input parameters: the amplitude, frequency, and speed of the wave, and the current time t. The function then calculates the new positions of three objects arranged in a line, with the distance between each object set to distance. The new positions are calculated based on the equation z = A * sin(w * (x - v * t)), where A is the amplitude, w is the frequency, v is the speed, and t is the current time. The function then returns a list of Point3d objects representing the new positions of the three objects. You can connect this script to a Grasshopper component to visualize the output points.
# This script is similar to the previous one, but it adds two new input parameters: totalTime, which is the total amount of time to simulate the wave motion, and timeStep, which is the time increment between each iteration. The script then loops through the total time in increments of the time step, and for each iteration, it calculates the new positions of the three objects based on the wave pattern, and saves the output to a list. Finally, it returns a list of lists, where each inner list contains the output points for one iteration.
# 
# To use this script in Grasshopper, you can create a new Script component, set its input parameters, and connect it to a List component to visualize the output. Here is an example Grasshopper definition that uses this script:
number_slider = Slider(50, range=0..50)

series = Series(Start=0, Step=Slider(2.8, range=0..10), Count=Slider(5, range=0..10))
Z = UnitZ(Factor=series)
geo = Geometry(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)
move = Move(Geometry=geo, Motion=Z)  # -> Geometry, Transform
area = Area(Geometry=move.Geometry)  # -> Area, Centroid
dist = Slider(5.1, range=0..10)
pl_origin = PlaneOrigin(Base=area.Centroid, Origin=area.Centroid)
c_script = CSharpScript(
    geoms=pl_origin,
    center=pl_origin,
    distance=dist,
    amplitude=Slider(1.7, range=0..10),
    cycles=Slider(2, range=0..30),
    stepCount=Slider(50, range=0..1000))  # -> out, A; inputs geoms: list of Plane, center: list of Point3d, distance: Double, amplitude: Double, cycles: Int32, stepCount: Double
# ---------- c_script: C# ----------
    _geoms = geoms;
    _center = center;
    A = WaveMotion(distance, amplitude, cycles, stepCount);
# ---------- c_script: C# additional code ----------
  List<Plane> _geoms;
  List<Point3d> _center;

  public DataTree<Plane> WaveMotion(double distance, double amplitude, double speed, double stepCount)
  {
    double frequency = RhinoMath.ToRadians(360.00 / stepCount);

    // Set up the list to store the output points for each iteration
    DataTree<Plane> output = new DataTree<Plane>();

    GH_Path pth = new  GH_Path(0);
    // Define the starting position and the distance between each object
    Point3d startingPos = new Point3d(0, 0, 0);

    int count = 0;

    // Loop through the total time in increments of the time step and calculate the new positions for each iteration
    for (double t = 0; t <= stepCount; t++)
    {
      // Set up the list to store the output points for this iteration
      List<Plane> iterationOutput = new List<Plane>();

      // Loop through the three objects and calculate their new positions based on the wave pattern
      for (int i = 0; i < _geoms.Count; i++)
      {
        double x = i * distance;

        double z = amplitude * Math.Sin(frequency * (x - speed * t));
        double rot = Math.Sin(frequency * (x - speed * t)) / 6;




        Plane brp = _geoms[i];

        brp = new Plane(brp);

        brp.Translate(new Vector3d(09, 0, z));

        //        brp.GetBoundingBox(
        brp.Rotate(rot, brp.ZAxis, brp.Origin);

        iterationOutput.Add(brp);
      }

      pth = new  GH_Path(count);

      // Add this iteration's output list to the main output list
      output.AddRange(iterationOutput, pth);

      count++;
    }

    // Return the list of output lists
    return output;
  }
# ---------- end c_script ----------
concat = Concatenate(FragmentA="{", FragmentB=number_slider, FragmentC="}")
split = SplitTree(Data=c_script.A, Masks=flatten(concat))  # -> flatten(Positive), Negative

range = Range(Domain=Domain(0, 1), Steps=Slider(16, range=0..100))
crv = Curve(reparameterize(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))
crv_2 = Curve(reparameterize(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))
crv_3 = Curve(reparameterize(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))
crv_4 = Curve(reparameterize(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))
tweencrv = TweenCurve(CurveA=crv, CurveB=crv_2, Factor=range, BlendType=0)
tweencrv_2 = TweenCurve(CurveA=crv_2, CurveB=crv_3, Factor=range, BlendType=0)
tweencrv_3 = TweenCurve(CurveA=crv_3, CurveB=crv_4, Factor=range, BlendType=0)
merge = Merge(Data1=tweencrv, Data2=tweencrv_2, Data3=tweencrv_3)

number_slider_2 = Slider(3.7, range=0..10)

# ----
# SpotLight
number_slider_3 = Slider(15, range=0..100)
color = ColourSwatch(SwatchColor=RGB(255, 255, 255))
pt = Point(Point(-8.828412895, -114.2999323, 117.4966152))
pt_2 = Point(Point(3.688271085, 2.443181571, 1.407192229))
c_script_2 = CSharpScript(
    color=color,
    pos=pt,
    focus=pt_2,
    deg=number_slider_3,
    hot=Slider(1, range=0..1),
    intens=Slider(0.1, range=0..10),
    shadow=Slider(0.6, range=0..1))  # -> out, A, B, C, D; inputs color: Color, pos: Point3d, focus: Point3d, deg: Double, hot: Double, intens: Double, shadow: Double
# ---------- c_script_2: C# usings ----------
using System.Linq;
using System.Drawing;
# ---------- c_script_2: C# ----------
    string name = "GH_Light";

    Rhino.DocObjects.LightObject lObj = RhinoDocument.Lights.FirstOrDefault(q => q.Name == name && !q.IsDeleted);

    Light light;




    if (lObj == null)
    {
      light = new Light();
      light.Name = name;

      int idx = RhinoDocument.Lights.Add(light);
      //
      //      lObj = RhinoDocument.Lights.FindIndex(idx);
    }

    lObj = RhinoDocument.Lights.FirstOrDefault(q => q.Name == name && !q.IsDeleted);

    light = lObj.LightGeometry;
    light.LightStyle = LightStyle.WorldSpot;
    light.Diffuse = color;
    light.Location = pos;
    light.Direction = focus - pos;
    light.SpotAngleRadians = RhinoMath.ToRadians(deg);
    light.Intensity = intens;
    light.HotSpot = hot;
    light.ShadowIntensity = shadow;

    lObj.CommitChanges();
# ---------- end c_script_2 ----------

multiplication = Multiplication(A="1200", B=number_slider_2)
panel = Panel(multiplication)
multiplication_2 = Multiplication(A="628", B=number_slider_2)
panel_2 = Panel(multiplication_2)

# ----
# Set View
z = Slider(26.1, range=0..200)
z_2 = Slider(19, range=0..60)
refresh = Button()
pt_3 = ConstructPoint(XCoordinate=expr("-x", z), YCoordinate=z, ZCoordinate=z_2)
viewer_c = CSharpScript(
    refresh=refresh,
    safe=Toggle(False),
    scale=Slider(110, range=1..200),
    width=multiplication,
    height=multiplication_2,
    dpi=Slider(72, range=0..1000),
    centerPoint=pt_3)  # -> out, CVec; inputs refresh: Boolean, safe: Boolean, scale: Double, width: Int32, height: Int32, dpi: Int32, centerPoint: Point3d
# ---------- viewer_c: C# usings ----------
using Rhino.Display;
# ---------- viewer_c: C# ----------
    if(refresh)
      return;

    RhinoView view = RhinoDoc.ActiveDoc.Views.ActiveView;
    RhinoViewport viewport = view.ActiveViewport;

    Vector3d camVec = new Vector3d(1, 1, -1);

    //Output

    CVec = camVec;

    //SetsVieport
    Rhino.RhinoDoc.ActiveDoc.Views.ActiveView.ActiveViewport.ChangeToParallelProjection(true);
    Rhino.RhinoDoc.ActiveDoc.Views.ActiveView.ActiveViewport.SetCameraDirection(camVec, true);
    Rhino.RhinoDoc.ActiveDoc.Views.ActiveView.ActiveViewport.ConstructionGridVisible = true;


    view.Size = new System.Drawing.Size(width, height);

    //Set Zoom Correct #Messy - but it works


    double facHeight = height / 2;
    double facWidth = width / 2;

    BoundingBox bBox = new BoundingBox(new Point3d(-facWidth, -facHeight, 0), new Point3d(facWidth, facHeight, 0));
    viewport.ZoomBoundingBox(bBox);

    double pixelPerUnit = 0;
    viewport.GetWorldToScreenScale(new Point3d(1, 1, 0), out pixelPerUnit);

    double facHeight2 = height / 2 * pixelPerUnit / scale;
    double facWidth2 = width / 2 * pixelPerUnit / scale;
    bBox = new BoundingBox(new Point3d(-facWidth2, -facHeight2, 0), new Point3d(facWidth2, facHeight2, 0));
    viewport.ZoomBoundingBox(bBox);
    // #Messy Ends

    // Set CamPos
    Point3d camPos = new Point3d(centerPoint.X, centerPoint.Y, centerPoint.Z);
    viewport.SetCameraLocation(camPos, true);

    Point3d camTarget = new Point3d(centerPoint.X, centerPoint.Y, centerPoint.Z);
    viewport.SetCameraTarget(camTarget, true);

    if(!safe)
      return;

    int imgFacWidth = Convert.ToInt32(width / 25.4f * dpi);
    int imgFacHeight = Convert.ToInt32(height / 25.4f * dpi);

    System.Drawing.Size imgSize = new System.Drawing.Size(imgFacWidth, imgFacHeight);
    System.Drawing.Bitmap bitm = view.CaptureToBitmap(imgSize);

    bitm.SetResolution(dpi, dpi);

    string filename = @"C:\Users\leonb\Google Drive\03_Hobby\Grasshopper\Lists\img\bla.png";
    System.Drawing.Imaging.ImageFormat imageformat = System.Drawing.Imaging.ImageFormat.Png;

    bitm.Save(filename, imageformat);
    bitm.Dispose();
# ---------- end viewer_c ----------

lng = ListLength(List=merge)

area_2 = Area(Geometry=crv_2)  # -> Area, Centroid
item = ListItem(List=split.Positive, Index=0, Wrap=True)
item_2 = ListItem(List=pl_origin, Index=0, Wrap=True)
vec2pt = Vector2Pt(PointA=item, PointB=item_2, Unitize=False)  # -> Vector, Length
item_3 = ListItem(List=merge, Index=number_slider, Wrap=True)
move_2 = Move(Geometry=split.Positive, Motion=vec2pt.Vector)  # -> Geometry, Transform
orient = Orient(Geometry=item_3, Source=area_2.Centroid, Target=simplify(graft(move_2.Geometry)))  # -> simplify(Geometry), Transform
offset = OffsetCurve(Curve=orient.Geometry, Distance=expr("-x", Slider(1, range=0..3)), Corners=0)  # -> simplify(Curve)
split_2 = SplitBrep(Brep=orient.Geometry, Cutter=offset)
offset_2 = OffsetCurve(Curve=orient.Geometry, Distance=Slider(0.15, range=0..1), Corners=1)
Z_2 = UnitZ(Factor=Slider(1.4, range=0..10))

panel_3 = Panel(lng)
item_4 = ListItem(List=split_2, Index=1, Wrap=True)

# ----
# Brep
edges = BrepEdges(Brep=offset_2)  # -> Naked, Interior, NonManifold
multiplication_3 = Multiplication(A=number_slider, B="7.2")
join = JoinCurves(Curves=edges.Naked, Preserve=True)
area_3 = Area(Geometry=join)  # -> Area, Centroid
series_2 = Series(Start=multiplication_3, Step=Slider(90, range=0..100), Count=Slider(5, range=0..10))  # -> simplify(graft(Series))
cyl = Cylinder(Base=area_3.Centroid, Radius=Slider(7, range=0..10), Length=Z_2)
extr = Extrude(Base=join, Direction=Z_2)
rotate = Rotate(Geometry=simplify(cyl), Angle=simplify(degrees(series_2)), Plane=simplify(area_3.Centroid))  # -> Geometry, Transform
brep = Brep(extr)

panel_4 = Panel(series_2)
vec = VectorXYZ(XComponent="1", YComponent="1", ZComponent=0)  # -> Vector, Length
extr_2 = Extrude(Base=item_4, Direction=Z_2)
box = Box(flatten(extr_2))
flatten = FlattenTree(Tree=extr_2, Path="{0}")

# ----
# Fillet Background
number_slider_4 = Slider(12, range=0..100)
number_slider_5 = Slider(16, range=0..100)
vec_2 = VectorXYZ(XComponent=number_slider_5, YComponent=expr("-x", number_slider_5), ZComponent=expr("-x", Slider(2.24, range=0..5)))  # -> Vector, Length
vec_3 = VectorXYZ(XComponent=number_slider_4, YComponent=number_slider_4, ZComponent=0)  # -> Vector, Length
crv_5 = Curve(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)
move_3 = Move(Geometry=crv_5, Motion=expr("-x", vec_2.Vector))  # -> Geometry, Transform
move_4 = Move(Geometry=move_3.Geometry, Motion=vec_3.Vector)  # -> Geometry, Transform
c_script_3 = CSharpScript(rect=move_4.Geometry, xyFac=Slider(0.7, range=0..1), bulge=Slider(0.5, range=0..1), length=Slider(37, range=0..100))  # -> out, A, B, C, D; inputs rect: Rectangle3d, xyFac: Double, bulge: Double, length: Double
# ---------- c_script_3: C# ----------
    Line lnA0 = new Line(rect.PointAt(1, 0), rect.PointAt(0, 0));



    NurbsCurve lnA = new Line(rect.PointAt(1, 0), rect.PointAt(xyFac, 0)).ToNurbsCurve();
    NurbsCurve lnB = new Line(rect.PointAt(0, xyFac), rect.PointAt(0, 1)).ToNurbsCurve();



    Curve blend = NurbsCurve.CreateBlendCurve(lnA, lnB, BlendContinuity.Curvature, bulge, bulge);

    List < Curve > crvs = new List<Curve>();
    crvs.Add(lnA);
    crvs.Add(lnB);
    crvs.Add(blend);

    Curve crv = Curve.JoinCurves(crvs, 0)[0];

    Surface surf = Rhino.Geometry.Surface.CreateExtrusion(crv, -rect.Plane.ZAxis * length);



    A = lnA;
    B = lnB;
    C = blend;
    D = surf;
# ---------- end c_script_3 ----------
mesh_uv = MeshSurface(Surface=c_script_3.D, UCount=Slider(11, range=0..100), VCount=Slider(19, range=0..100), Overhang=True, Equalize=False)
demesh = DeconstructMesh(Mesh=mesh_uv)  # -> Vertices, Faces, Colours, Normals
number_slider_6 = Slider(1.33, range=0..5)
dom_start = Slider(1.39, range=0..5)
lng_2 = ListLength(List=demesh.Vertices)
dom = ConstructDomain(DomainStart=expr("-x", dom_start), DomainEnd=0)
dom_2 = ConstructDomain(DomainStart=expr("-x", number_slider_6), DomainEnd=number_slider_6)
random = Random(Range=dom, Number=lng_2, Seed=Slider(7, range=0..10))
random_2 = Random(Range=dom_2, Number=lng_2, Seed=Slider(4, range=0..10))
random_3 = Random(Range=dom_2, Number=lng_2, Seed=Slider(3, range=0..10))
vec_4 = VectorXYZ(XComponent=random_2, YComponent=random_3, ZComponent=random)  # -> Vector, Length
move_5 = Move(Geometry=demesh.Vertices, Motion=vec_4.Vector)  # -> Geometry, Transform
conmesh = ConstructMesh(Vertices=move_5.Geometry, Faces=demesh.Faces)
preview = CustomPreview(Geometry=conmesh, Material=ColourSwatch(SwatchColor=RGB(255, 191, 0)))

item_5 = ListItem(List=flatten, Index=0, Wrap=True)
area_4 = Area(Geometry=item_5)  # -> Area, Centroid
pt_4 = Point(Point(-9.826341202, 26.9778843, 3.445133044))
vec2pt_2 = Vector2Pt(PointA=area_4.Centroid, PointB=pt_4, Unitize=False)  # -> Vector, Length
move_6 = Move(Geometry=extr_2, Motion=vec2pt_2.Vector)  # -> Geometry, Transform
preview_2 = CustomPreview(Geometry=move_6.Geometry, Material=ColourSwatch(SwatchColor=RGB(250, 250, 250)))

crv_6 = Curve(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)
debox = DeconstructBox(Box=crv_6)  # -> Plane, X, Y, Z
dedomain = DeconstructDomain(Domain=debox.X)  # -> Start, End
dedomain_2 = DeconstructDomain(Domain=debox.Y)  # -> Start, End
subtraction = Subtraction(A=dedomain.End, B=dedomain.Start)
subtraction_2 = Subtraction(A=dedomain_2.End, B=dedomain_2.Start)
division = Division(A="1", B=subtraction)
division_2 = Division(A=Slider(0.78, range=0..1), B=subtraction_2)

end = EndPoints(Curve=crv_6)  # -> Start, End

pt_5 = Point(end.Start)
scale_nu = ScaleNU(Geometry=crv_6, Plane=pt_5, ScaleX=division, ScaleY=division_2, ScaleZ=1)  # -> Geometry, Transform
move_7 = Move(Geometry=scale_nu.Geometry, Motion=expr("-x", pt_5))  # -> Geometry, Transform
divide = DivideCurve(Curve=reparameterize(move_7.Geometry), Count=Slider(200, range=0..1000), Kinks=False)  # -> Points, Tangents, Parameters

srf = Surface(reparameterize(rotate.Geometry))
pt_6 = ConstructPoint(XCoordinate=0, YCoordinate=Slider(1, range=0..1), ZCoordinate=0)
number_slider_7 = Slider(180, range=0..200)
iso = IsoCurve(Surface=srf, UVPoint=pt_6)  # -> UIsocurve, VIsocurve
divide_2 = DivideCurve(Curve=iso.UIsocurve, Count=number_slider_7, Kinks=False)  # -> Points, Tangents, Parameters
line = LineSDL(Start=divide_2.Points, Direction=Vector(0, 0, -1), Length=100)
crvsrf = CurveOnSurface(Surface=srf, UVCoordinates=divide.Points, Closed=False)  # -> Curve, Length, Domain
ccx = CurveCurve(CurveA=crvsrf.Curve, CurveB=line)  # -> Points, ParamsA, ParamsB
shatter = Shatter(Curve=graft(line), Parameters=simplify(ccx.ParamsB))
item_6 = ListItem(List=shatter, Index=0, Wrap=True)  # -> simplify(Item)
end_2 = EndPoints(Curve=item_6)  # -> Start, End

path_mapper = PathMapper(end_2.Start, source="{a;b}", target="{a}")
move_8 = Move(Geometry=area_3.Centroid, Motion=Z_2)  # -> Geometry, Transform
repeat = RepeatData(Data=brep, Length=number_slider_7)  # -> simplify(graft(Data))
vec2pt_3 = Vector2Pt(PointA=simplify(path_mapper), PointB=simplify(move_8.Geometry), Unitize=False)  # -> graft(Vector), Length
move_9 = Move(Geometry=offset_2, Motion=Z_2)  # -> Geometry, Transform
project = Project(Curve=simplify(item_6), Brep=simplify(repeat), Direction=simplify(vec2pt_3.Vector))

project_2 = ProjectPoint(Point=end_2.End, Direction=vec2pt_3.Vector, Geometry=repeat)  # -> Point, Index
path_mapper_2 = PathMapper(project_2.Point, source="{a;b}", target="{a}")
intcrv = Interpolate(Vertices=path_mapper_2, Degree=3, Periodic=True, KnotStyle=1)  # -> Curve, Length, Domain

pt_7 = Point(Point(-5.592938105, 42.48675859, 0.550002329))
dom_3 = ConstructDomain(DomainStart=Slider(0.2, range=0..10), DomainEnd=Slider(0.5, range=0..10))

pl = ConstructPlane(Origin=pt_7, XAxis=vec.Vector, YAxis=Vector(0, 1, 0))

deplane = DeconstructPlane(Plane=pl)  # -> Origin, XAxis, YAxis, ZAxis
line_2 = LineSDL(Start=deplane.Origin, Direction=deplane.YAxis, Length=1)
rotax = RotateAxis(Geometry=pl, Angle=degrees(-45), Axis=line_2)  # -> Geometry, Transform
cir = Circle(Plane=rotax.Geometry, Radius=Slider(15, range=0..100))
srf_2 = Surface(cir)
popgeo = PopulateGeometry(Geometry=srf_2, Count=Slider(300, range=0..1000), Seed=1)
vec2pt_4 = Vector2Pt(PointA=popgeo, PointB=pt_7, Unitize=False)  # -> unitize(Vector), Length
bnd = Bounds(Numbers=vec2pt_4.Length)
remap = RemapNumbers(Value=vec2pt_4.Length, Source=bnd, Target=Domain(0, 1))  # -> Mapped, Clipped
graph = GraphMapper(
    remap.Mapped,
    x0=0,
    x1=1,
    y0=0,
    y1=1,
    container_name="Bezier",
    cpx=[0, 0.3482142985, 0.7232142687, 1],
    cpy=[0, 0.2137681246, 0.2427536249, 0])
remap_2 = RemapNumbers(Value=graph, Source=Domain(0, 1), Target=bnd)  # -> Mapped, Clipped
multiplication_4 = Multiplication(A=vec2pt_4.Vector, B=remap_2.Mapped)
move_10 = Move(Geometry=popgeo, Motion=multiplication_4)  # -> Geometry, Transform
xy = XYPlane(Origin=move_10.Geometry)
lng_3 = ListLength(List=xy)
random_4 = Random(Range=Domain(-360, 360), Number=lng_3, Seed=2)
random_5 = Random(Range=Domain(-360, 360), Number=lng_3, Seed=Slider(4, range=0..10))
rotate_2 = Rotate(Geometry=xy, Angle=degrees(random_4), Plane=xy)  # -> Geometry, Transform
yz = YZPlane(Origin=xy)
random_6 = Random(Range=Domain(-360, 360), Number=lng_3, Seed=Slider(4, range=0..10))
rotate_3 = Rotate(Geometry=rotate_2.Geometry, Angle=degrees(random_6), Plane=yz)  # -> Geometry, Transform
xz = XZPlane(Origin=yz)
rotate_4 = Rotate(Geometry=rotate_3.Geometry, Angle=degrees(random_5), Plane=xz)  # -> Geometry, Transform
lng_4 = ListLength(List=rotate_3.Geometry)
division_3 = Division(A=lng_3, B=3)
split_3 = SplitList(List=rotate_4.Geometry, Index=division_3)  # -> ListA, ListB
random_7 = Random(Range=dom_3, Number=lng_4, Seed=29)
split_4 = SplitList(List=split_3.ListB, Index=division_3)  # -> ListA, ListB
cir_2 = Circle(Plane=split_3.ListA, Radius=random_7)
polygon = Polygon(Plane=split_4.ListA, Radius=random_7, Segments="3", FilletRadius=0)  # -> Polygon, Length
polygon_2 = Polygon(Plane=split_4.ListB, Radius=random_7, Segments=expr("x+1", "3"), FilletRadius=0)  # -> Polygon, Length
merge_2 = Merge(Data1=flatten(polygon.Polygon), Data2=flatten(polygon.Polygon), Data3=flatten(polygon_2.Polygon))
srf_3 = Surface(merge_2)
lng_5 = ListLength(List=srf_3)
random_8 = Random(Range=Domain(0, 1), Number=lng_5, Seed=2)
gradient = Gradient(LowerLimit=0, UpperLimit=1, Parameter=random_8, stops=[0: RGB(255, 255, 0), 1: RGB(218, 165, 32)])

material = CreateMaterial(Diffuse=gradient, Specular=gradient, Emission=RGB(0, 0, 0), Transparency=0, Shine=0)

preview_3 = CustomPreview(Geometry=srf_3, Material=material)

# ----
# Display
number_slider_8 = Slider(0.03, range=0..0.1)
merge_3 = Merge(Data1=intcrv.Curve, Data2=project, Data3=move_9.Geometry)
pipe = Pipe(Curve=merge_3, Radius=number_slider_8, Caps=0)

move_11 = Move(Geometry=pipe, Motion=vec2pt_2.Vector)  # -> Geometry, Transform

preview_4 = CustomPreview(Geometry=move_11.Geometry, Material=ColourSwatch(SwatchColor=RGB(145, 145, 145)))
