# Grasshopper definition cake.gh (Grasshopper 1.0.8)
# plug-ins: treesloth01, MetaHopper

number_slider = Slider(53, range=0..100)
cir = Circle(Plane=PlaneXY(0, 0, 0), Radius=Slider(15, range=0..100))

n = Slider(47, range=0..100)
divide = DivideCurve(Curve=cir, Count=n, Kinks=False)  # -> Points, Tangents, Parameters
xprod = CrossProduct(VectorA=divide.Tangents, VectorB=Vector(0, 0, 1), Unitize=False)  # -> Vector, Length
pl = ConstructPlane(Origin=divide.Points, XAxis=Vector(0, 0, 1), YAxis=xprod.Vector)

lng = ListLength(List=pl)
neg = Negative(Value=Slider(45, range=0..100))
neg_2 = Negative(Value=Slider(6.8, range=0..10))
series = Series(Start=neg, Step=neg_2, Count=lng)
Y = UnitY(Factor=series)
move = Move(Geometry=PlaneXY(0, 0, 0), Motion=Y)  # -> Geometry, Transform

# ----
# REF BREP
number_slider_2 = Slider(0, range=0..100)
brep = Brep(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)
box = Box(brep)
area = Area(Geometry=box)
scale = Scale(Geometry=brep, Center=area, Factor=Slider(0.94, range=0..3))  # -> Geometry, Transform
vec = VectorXYZ(XComponent=number_slider_2, YComponent=Slider(0, range=0..100), ZComponent=0)  # -> Vector, Length
move_2 = Move(Geometry=scale.Geometry, Motion=vec.Vector)  # -> Geometry, Transform

multiplication = Multiplication(A=xprod.Vector, B=Slider(5, range=0..10))
line = LineSDL(Start=divide.Points, Direction=Vector(0, 0, 1), Length=number_slider)
extr = Extrude(Base=line, Direction=multiplication)

splitmul = SplitBrepMultiple(Brep=simplify(graft(extr)), Cutters=move_2.Geometry)  # -> simplify(Result)
popgeo = PopulateGeometry(Geometry=splitmul, Count=1, Seed=Slider(3, range=0..10))
brepinc = PointInBrep(Brep=move_2.Geometry, Point=popgeo, Strict=False)
shift = ShiftPaths(Data=brepinc, Offset=-1)
cull = CullPattern(List=splitmul, CullPattern=invert(shift))
group = Group(Geometry=cull)
orient = Orient(Geometry=group, Source=graft(pl), Target=graft(move.Geometry))  # -> Geometry, Transform

swatch = ColourSwatch(SwatchColor=RGB(219, 204, 213))

# ----
# Cake
Z = UnitZ(Factor=number_slider)
extr_2 = Extrude(Base=cir, Direction=Z)
cap = CapHoles(Brep=extr_2)
preview = CustomPreview(Geometry=cap, Material=swatch)
toggle = GroupToggle(ToggleActive=True, ToggleVisible=False)  # disabled

# ----
# Fins
number_slider_3 = Slider(0.6, range=0..1)
ungroup = Ungroup(Group=group)
vec_2 = Vector(ungroup)
multiplication_2 = Multiplication(A=number_slider_3, B=vec_2)
extr_3 = Extrude(Base=ungroup, Direction=multiplication_2)
toggle_2 = GroupToggle(ToggleActive=True, ToggleVisible=False)  # disabled
preview_2 = CustomPreview(Geometry=extr_3, Material=swatch)

# ----
# Flat
preview_3 = CustomPreview(Geometry=orient.Geometry, Material=swatch)
toggle_3 = GroupToggle(ToggleActive=True, ToggleVisible=False)  # disabled
