# Grasshopper definition dataRecorderCSharp.gh (Grasshopper 1.0.7)

author = CSharpScript()  # -> Output
# ---------- author: C# usings ----------
using System.IO;
using System.Linq;
using System.Data;
using System.Drawing;
using System.Reflection;
using System.Windows.Forms;
using System.Xml;
using System.Xml.Linq;
using System.Runtime.InteropServices;

using Rhino.DocObjects;
using Rhino.Collections;
using GH_IO;
using GH_IO.Serialization;
# ---------- author: C# ----------
    Output = new List<string>(){
        "Leon Brohmann",
        "Computational Designer",
        "leonbrohmann@gmx.de",
        "www.leonbrohmann.de"
        };
# ---------- author: C# additional code ----------
  //Draw all meshes in this method.
  public override void DrawViewportMeshes(IGH_PreviewArgs args)
  {
    Plane plane;
    args.Viewport.GetCameraFrame(out plane);

    Rectangle bounds = args.Viewport.Bounds;

    int width = 320;
    int height = 34;

    int distW = bounds.Width - width - 40;
    int distH = bounds.Height - height - 40;

    Color _color = ColorTranslator.FromHtml("#004187");

    args.Display.Draw2dRectangle(new Rectangle(distW, distH, width, height), Color.White, 0, Color.White);
    args.Display.Draw2dText("LEONBROHMANN.DE", Color.Black, new Point2d(distW + 4, distH + 7), false, 30);
  }
# ---------- end author ----------
panel = Panel(author)

ison = BooleanToggle(True)
# DataRecorder
c_recorder = CSharpScript(IsOn=ison, Reset=Button(), Rec=Slider(49, range=0..100))  # -> out, Recorded; inputs IsOn: Boolean, Reset: Boolean
# ---------- c_recorder: C# ----------
    Recorded = _recorded;

    if (Reset)
    {
      _recorded.Clear();
      return;
    }

    if (!IsOn)
    {
      return;
    }

    if (Rec != null) //Doesn't record null objects
    {
      _recorded.Add(Rec);
    }

    Recorded = _recorded;
# ---------- c_recorder: C# additional code ----------
  static List<object> _recorded = new List<object>();
# ---------- end c_recorder ----------

# ----
# Simple DataRecorder written in C#
# 
# Link to Thread:
# https://www.linkedin.com/posts/leonbrohmann_computationaldesign-grasshopper-bughunt-activity-7009195333859618817-waop?utm_source=share&utm_medium=member_desktop
panel_2 = Panel("Summary")

panel_3 = Panel(c_recorder.Recorded)
