# Grasshopper definition Display.DrawCurve.gh (Grasshopper 1.0.7)

author = CSharpScript()  # -> Output
# ---------- author: C# usings ----------
using System.IO;
using System.Linq;
using System.Data;
using System.Drawing;
using System.Reflection;
using System.Windows.Forms;
using System.Xml;
using System.Xml.Linq;
using System.Runtime.InteropServices;

using Rhino.DocObjects;
using Rhino.Collections;
using GH_IO;
using GH_IO.Serialization;
# ---------- author: C# ----------
    Output = new List<string>(){
        "Leon Brohmann",
        "Computational Designer",
        "leonbrohmann@gmx.de",
        "www.leonbrohmann.de"
        };
# ---------- author: C# additional code ----------
  //Draw all meshes in this method.
  public override void DrawViewportMeshes(IGH_PreviewArgs args)
  {
    Plane plane;
    args.Viewport.GetCameraFrame(out plane);

    Rectangle bounds = args.Viewport.Bounds;

    int width = 320;
    int height = 34;

    int distW = bounds.Width - width - 40;
    int distH = bounds.Height - height - 40;

    Color _color = ColorTranslator.FromHtml("#004187");

    args.Display.Draw2dRectangle(new Rectangle(distW, distH, width, height), Color.White, 0, Color.White);
    args.Display.Draw2dText("LEONBROHMANN.DE", Color.Black, new Point2d(distW + 4, distH + 7), false, 30);
  }
# ---------- end author ----------
panel = Panel(author)

# ----
# Color Curve
number_slider = Slider(6, range=0..10)
crv = Curve(Tree({0;0}: [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], {0;1}: [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]))
c_colour = CSharpScript(width=number_slider, color=ColourSwatch(SwatchColor=RGB(51, 139, 255)), crvs=crv)  # inputs width: Int32, color: Color, crvs: tree of Curve
# ---------- c_colour: C# usings ----------
using System.Drawing;
# ---------- c_colour: C# ----------
    _width = width;
    _color = color;
    _crvs = crvs.AllData(); // DataTree<Curve> to List<Curve>
# ---------- c_colour: C# additional code ----------
  List<Curve> _crvs = new List<Curve>();
  Color _color;
  int _width;

  //What does override do?
  //https://www.geeksforgeeks.org/c-sharp-method-overriding/
  public override void DrawViewportMeshes(IGH_PreviewArgs args)
  {
    //Is needed, to clear Geometry after the component is diabled
    if (this.Component.Locked)
      _crvs.Clear();

    for (int i = 0; i < _crvs.Count; i++)
    {
      Curve crv = _crvs[i];
      args.Display.DrawCurve(crv, _color, _width);
    }
  }
# ---------- end c_colour ----------

# ----
# Gradient Color Curve
crv_2 = Curve(Tree({0}: [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], {1}: [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], {2}: [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], {3}: [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], {4}: [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], {5}: [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]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))
tstat = TreeStatistics(Tree=crv_2)  # -> Paths, Length, Count
range = Range(Domain=Domain(0, 1), Steps=expr("x-1", tstat.Count))
gradient = Gradient(
    LowerLimit=0,
    UpperLimit=1,
    Parameter=range,
    stops=[0: RGB(234, 38, 0), 0.25: RGB(234, 126, 0), 0.5: RGB(254, 244, 84), 0.75: RGB(173, 203, 249), 1: RGB(75, 107, 169)])
c_colour_2 = CSharpScript(width=Slider(3, range=0..10), crvTree=crv_2, colors=gradient)  # inputs width: Int32, crvTree: tree of Curve, colors: list of Color
# ---------- c_colour_2: C# ----------
    _width = width;
    _colors = colors;
    _crvTree = crvTree;
# ---------- c_colour_2: C# additional code ----------
  List<Color> _colors;
  DataTree<Curve> _crvTree;
  int _width;

  public override void DrawViewportMeshes(IGH_PreviewArgs args)
  {
    //Is needed, to clear Geometry after the component is diabled
    if (this.Component.Locked)
      _crvTree.Clear();

    for (int u = 0; u < _crvTree.BranchCount; u++)
    {
      GH_Path pths = _crvTree.Paths[u];
      List<Curve> crvs = _crvTree.Branch(pths);

      Color color = _colors[u];

      for (int i = 0; i < crvs.Count; i++)
      {
        Curve crv = crvs[i];

        if (crv == null)
          continue;

        args.Display.DrawCurve(crv, color, _width);
      }
    }
  }
# ---------- end c_colour_2 ----------

# ----
# How to draw colored curves with the help of  the display pipeline class
# 
# https://developer.rhino3d.com/api/RhinoCommon/html/M_Rhino_Display_DisplayPipeline_DrawCurve_1.htm
panel_2 = Panel("Summary")
