# Grasshopper definition Display.DrawPoints.gh (Grasshopper 1.0.7)

author = CSharpScript()  # -> Output
# ---------- author: C# usings ----------
using System.IO;
using System.Linq;
using System.Data;
using System.Drawing;
using System.Reflection;
using System.Windows.Forms;
using System.Xml;
using System.Xml.Linq;
using System.Runtime.InteropServices;

using Rhino.DocObjects;
using Rhino.Collections;
using GH_IO;
using GH_IO.Serialization;
# ---------- author: C# ----------
    Output = new List<string>(){
        "Leon Brohmann",
        "Computational Designer",
        "leonbrohmann@gmx.de",
        "www.leonbrohmann.de"
        };
# ---------- author: C# additional code ----------
  //Draw all meshes in this method.
  public override void DrawViewportMeshes(IGH_PreviewArgs args)
  {
    Plane plane;
    args.Viewport.GetCameraFrame(out plane);

    Rectangle bounds = args.Viewport.Bounds;

    int width = 320;
    int height = 34;

    int distW = bounds.Width - width - 40;
    int distH = bounds.Height - height - 40;

    Color _color = ColorTranslator.FromHtml("#004187");

    args.Display.Draw2dRectangle(new Rectangle(distW, distH, width, height), Color.White, 0, Color.White);
    args.Display.Draw2dText("LEONBROHMANN.DE", Color.Black, new Point2d(distW + 4, distH + 7), false, 30);
  }
# ---------- end author ----------
panel = Panel(author)

# ----
# Points
pop3d = Populate3D(Region={Plane=PlaneXY(0, 0, 0), X=Domain(0, 10), Y=Domain(0, 10), Z=Domain(0, 2)}, Count=100, Seed=1)

# ----
# Rhino.Display.PointStyle
# PointStyles: https://developer.rhino3d.com/api/RhinoCommon/html/T_Rhino_Display_PointStyle.htm
idx = Slider(15, range=0..15)
c_pointstyle = CSharpScript(val=idx)  # -> out, Value, Member, Description; inputs val: Int32
# ---------- c_pointstyle: C# ----------
    if (val < 0 || val > 15)
    {
      throw new Exception("The value of the enum Rhino.Display.PointStyle can't be loer then 0 or higher then 15");
    }

    List < string > members = new   List<string>(){
        "Simple",
        "ControlPoint",
        "ActivePoint",
        "X",
        "RoundSimple",
        "RoundControlPoint",
        "RoundActivePoint",
        "Circle",
        "Square",
        "Triangle",
        "Heart",
        "Chevron",
        "Clover",
        "Tag",
        "Asterisk",
        "Pin",
        "ArrowTail",
        "ArrowTip"
        };

    List < string > descriptions = new   List<string>(){
        "Square",
        "Square with white center",
        "Like a control point but includes vertical / horizontal crosshair lines.",
        "X shape",
        "Circular",
        "Circular with white center",
        "Round control point with crosshair lines",
        "Circle or ring shape when secondarySize is set",
        "Square or diamond shape when rotated",
        "Triangular shape",
        "Heart shape",
        "Chevron shape (two directional arrows)",
        "Three unioned circles",
        "Tag shape",
        "* shape",
        "Map style pin symbol. secondarySize defines hole zie in pin",
        "Arrow shape with tail as definition point.Shape is offset from tail by secondarySize.",
        "Arrow shape with tip as definition point. Shape is offset from tip by secondarySize."
        };

    //Output
    Value = val;
    Member = members[val];
    Description = descriptions[val];
# ---------- end c_pointstyle ----------
panel_2 = Panel(c_pointstyle.Member)
panel_3 = Panel(c_pointstyle.Description)

# ----
# How to draw colored points with the help of the display pipeline class.Change the Appereance with the Pointstyle
# 
# https://developer.rhino3d.com/api/RhinoCommon/html/M_Rhino_Display_DisplayPipeline_DrawCurve_1.htm
panel_4 = Panel("Summary")

panel_5 = Panel(c_pointstyle.Value)

# ----
# DrawPoints
number_slider = Slider(5, range=0..10)
c_drawpts = CSharpScript(radius=number_slider, color=ColourSwatch(SwatchColor=RGB(51, 139, 255)), pts=pop3d, ptStyle=panel_5)  # inputs radius: Int32, color: Color, pts: tree of Point3d, ptStyle: Int32
# ---------- c_drawpts: C# usings ----------
using System.Drawing;
using Rhino.Display;
# ---------- c_drawpts: C# ----------
    _radius = radius;
    _color = color;
    _pts = pts.AllData(); // DataTree<Curve> to List<Curve>
    _ptStyle = (PointStyle) ptStyle; //Explicit Type Conversion - See https://www.programiz.com/csharp-programming/type-conversion
# ---------- c_drawpts: C# additional code ----------
  List<Point3d> _pts = new List<Point3d>();
  Color _color;
  int _radius;
  PointStyle _ptStyle;

  //What does override do?
  //https://www.geeksforgeeks.org/c-sharp-method-overriding/
  public override void DrawViewportMeshes(IGH_PreviewArgs args)
  {
    //Is needed, to clear Geometry after the component is diabled
    if (this.Component.Locked)
      _pts.Clear();

    args.Display.DrawPoints(_pts, _ptStyle, _radius, _color);
  }
# ---------- end c_drawpts ----------
