# Grasshopper definition DisplayPlane.gh (Grasshopper 1.0.7)

author = CSharpScript()  # -> Output
# ---------- author: C# usings ----------
using System.IO;
using System.Linq;
using System.Data;
using System.Drawing;
using System.Reflection;
using System.Windows.Forms;
using System.Xml;
using System.Xml.Linq;
using System.Runtime.InteropServices;

using Rhino.DocObjects;
using Rhino.Collections;
using GH_IO;
using GH_IO.Serialization;
# ---------- author: C# ----------
    Output = new List<string>(){
        "Leon Brohmann",
        "Computational Designer",
        "leonbrohmann@gmx.de",
        "www.leonbrohmann.de"
        };
# ---------- author: C# additional code ----------
  //Draw all meshes in this method.
  public override void DrawViewportMeshes(IGH_PreviewArgs args)
  {
    Plane plane;
    args.Viewport.GetCameraFrame(out plane);

    Rectangle bounds = args.Viewport.Bounds;

    int width = 320;
    int height = 34;

    int distW = bounds.Width - width - 40;
    int distH = bounds.Height - height - 40;

    Color _color = ColorTranslator.FromHtml("#004187");

    args.Display.Draw2dRectangle(new Rectangle(distW, distH, width, height), Color.White, 0, Color.White);
    args.Display.Draw2dText("LEONBROHMANN.DE", Color.Black, new Point2d(distW + 4, distH + 7), false, 30);
  }
# ---------- end author ----------
panel = Panel(author)

# ----
# Plane
pt = Point(Point(136.4332429, -15.59142822, 0))
xz = XZPlane(Origin=pt)
rotate = Rotate(Geometry=xz, Angle=degrees(30), Plane=xz)  # -> Geometry, Transform

# ----
# Displays a Custom Plane over the Viewport
panel_2 = Panel("Summary")

# ----
# Plane Display
# Arrow
# Plane
toggle = BooleanToggle(True)
c_displpln = CSharpScript(
    length=Slider(29, range=0..100),
    thickness=Slider(5, range=0..10),
    tipSize=Slider(21, range=0..100),
    pln=rotate.Geometry,
    plnSize=Slider(80, range=0..100),
    plnSegm=Slider(8, range=0..10),
    plnSegmLngth=Slider(5, range=0..10),
    plnColor=ColourSwatch(SwatchColor=RGB(56, 66, 255)),
    plnThickness=Slider(2, range=0..10),
    hasPlnOutline=toggle)  # inputs length: Double, thickness: Int32, tipSize: Int32, pln: Plane, plnSize: Double, plnSegm: Int32, plnSegmLngth: Int32, plnColor: Color, plnThickness: Int32, hasPlnOutline: Boolean
# ---------- c_displpln: C# usings ----------
using System.Drawing;
# ---------- c_displpln: C# ----------
    _pln = pln;
    _length = length;
    _thickness = thickness;
    _tipSize = tipSize;
    _plnColor = plnColor;
    _plnThickness = plnThickness;

    plnLns = new List<Line>();

    //Create Plane Crosses
    double lnFac = plnSize / plnSegm;
    double startUV = plnSize / 2.00;
    double crRadius = plnSegmLngth / 2.00;

    //Cross stitches
    for (int i = 0; i < plnSegm + 1; i++)
    {
      double u = lnFac * i - startUV;

      double uA, uB;

      //Border U
      if (i == 0)
        uA = u;
      else
        uA = u - crRadius;

      if (i == plnSegm)
        uB = u;
      else
        uB = u + crRadius;

      for (int q = 0; q < plnSegm + 1; q++)
      {
        double vC, vD;

        double v = lnFac * q - startUV;

        //Border V
        if (q == 0)
          vC = v;
        else
          vC = v - crRadius;

        if (q == plnSegm)
          vD = v;
        else
          vD = v + crRadius;

        Point3d ptA = pln.PointAt(uA, v);
        Point3d ptB = pln.PointAt(uB, v);
        Line lnAB = new Line(ptA, ptB);
        plnLns.Add(lnAB);

        Point3d ptC = pln.PointAt(u, vC);
        Point3d ptD = pln.PointAt(u, vD);
        Line lnCD = new Line(ptC, ptD);
        plnLns.Add(lnCD);
      }
    }

    if (!hasPlnOutline)
      return;

    Point3d pt1 = pln.PointAt(-startUV, -startUV);
    Point3d pt2 = pln.PointAt(-startUV, startUV);
    Point3d pt3 = pln.PointAt(startUV, -startUV);
    Point3d pt4 = pln.PointAt(startUV, startUV);

    Line ln1 = new Line(pt1, pt2);
    Line ln2 = new Line(pt1, pt3);
    Line ln3 = new Line(pt2, pt4);
    Line ln4 = new Line(pt4, pt3);
    plnLns.Add(ln1);
    plnLns.Add(ln2);
    plnLns.Add(ln3);
    plnLns.Add(ln4);
# ---------- c_displpln: C# additional code ----------
  int _thickness,_tipSize,_plnThickness;
  Plane _pln;
  double _length;
  List<Line> plnLns;
  Color _plnColor;

  //Draw all meshes in this method.
  public override void DrawViewportMeshes(IGH_PreviewArgs args)
  {
    DrawArrow(args, _pln.XAxis, Color.Red);
    DrawArrow(args, _pln.YAxis, Color.Green);
    DrawArrow(args, _pln.ZAxis, Color.Blue);

    for (int i = 0; i < plnLns.Count; i++)
      args.Display.DrawLine(plnLns[i], _plnColor, _plnThickness);
  }

  void DrawArrow(IGH_PreviewArgs args, Vector3d dir, Color c)
  {
    Line ln = new Line(_pln.Origin, dir, _length);
    args.Display.DrawLine(ln.From, ln.To, c, _thickness);
    args.Display.DrawArrowHead(ln.To, dir, c, _tipSize, 1);
  }
# ---------- end c_displpln ----------
