# Grasshopper definition SetDisplayMode.gh (Grasshopper 1.0.7)

author = CSharpScript()  # -> Output
# ---------- author: C# usings ----------
using System.IO;
using System.Linq;
using System.Data;
using System.Drawing;
using System.Reflection;
using System.Windows.Forms;
using System.Xml;
using System.Xml.Linq;
using System.Runtime.InteropServices;

using Rhino.DocObjects;
using Rhino.Collections;
using GH_IO;
using GH_IO.Serialization;
# ---------- author: C# ----------
    Output = new List<string>(){
        "Leon Brohmann",
        "Computational Designer",
        "leonbrohmann@gmx.de",
        "www.leonbrohmann.de"
        };
# ---------- author: C# additional code ----------
  //Draw all meshes in this method.
  public override void DrawViewportMeshes(IGH_PreviewArgs args)
  {
    Plane plane;
    args.Viewport.GetCameraFrame(out plane);

    Rectangle bounds = args.Viewport.Bounds;

    int width = 320;
    int height = 34;

    int distW = bounds.Width - width - 40;
    int distH = bounds.Height - height - 40;

    Color _color = ColorTranslator.FromHtml("#004187");

    args.Display.Draw2dRectangle(new Rectangle(distW, distH, width, height), Color.White, 0, Color.White);
    args.Display.Draw2dText("LEONBROHMANN.DE", Color.Black, new Point2d(distW + 4, distH + 7), false, 30);
  }
# ---------- end author ----------
panel = Panel(author)

# ----
# SetDisplaymode
number_slider = Slider(0, range=0..9)
c_script = CSharpScript(displayIdx=number_slider)  # -> out, DisplayModes, CurrentDisplayMode; inputs displayIdx: Int32
# ---------- c_script: C# usings ----------
 using Rhino.ApplicationSettings;
using Rhino.Display;
using System.Drawing;
# ---------- c_script: C# ----------
    //Just to display the different Displaymodes
    List<string> names = new  List<string>();

    DisplayModeDescription[] descriptions = DisplayModeDescription.GetDisplayModes();

    foreach (DisplayModeDescription descr in descriptions)
      names.Add(descr.EnglishName);

    //Set Displaymode
    string engName = names[displayIdx];

    DisplayModeDescription mode = DisplayModeDescription.FindByName(engName);
    Rhino.RhinoDoc.ActiveDoc.Views.ActiveView.ActiveViewport.DisplayMode = mode;

    //Output
    DisplayModes = names;
    CurrentDisplayMode = engName;
# ---------- end c_script ----------
panel_2 = Panel(c_script.DisplayModes)
panel_3 = Panel(c_script.CurrentDisplayMode)

# ----
# Visualisation
swatch = ColourSwatch(SwatchColor=RGB(69, 255, 249))
geo = Geometry([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])
preview = CustomPreview(Geometry=geo, Material=swatch)

# ----
# C# Example how to change the active Viewport DisplayMode.
panel_4 = Panel("Summary")
