# Grasshopper definition ExtendSurface.gh (Grasshopper 1.0.7)

author = CSharpScript()  # -> Output
# ---------- author: C# usings ----------
using System.IO;
using System.Linq;
using System.Data;
using System.Drawing;
using System.Reflection;
using System.Windows.Forms;
using System.Xml;
using System.Xml.Linq;
using System.Runtime.InteropServices;

using Rhino.DocObjects;
using Rhino.Collections;
using GH_IO;
using GH_IO.Serialization;
# ---------- author: C# ----------
    Output = new List<string>(){
        "Leon Brohmann",
        "Computational Designer",
        "leonbrohmann@gmx.de",
        "www.leonbrohmann.de"
        };
# ---------- author: C# additional code ----------
  //Draw all meshes in this method.
  public override void DrawViewportMeshes(IGH_PreviewArgs args)
  {
    Plane plane;
    args.Viewport.GetCameraFrame(out plane);

    Rectangle bounds = args.Viewport.Bounds;

    int width = 320;
    int height = 34;

    int distW = bounds.Width - width - 40;
    int distH = bounds.Height - height - 40;

    Color _color = ColorTranslator.FromHtml("#004187");

    args.Display.Draw2dRectangle(new Rectangle(distW, distH, width, height), Color.White, 0, Color.White);
    args.Display.Draw2dText("LEONBROHMANN.DE", Color.Black, new Point2d(distW + 4, distH + 7), false, 30);
  }
# ---------- end author ----------
panel = Panel(author)

# ----
# Extend Surface - Example B
north = Slider(4, range=0..100)
east = Slider(11, range=0..100)
south = Slider(26, range=0..100)
west = Slider(24, range=0..100)
# Extend Surface - Example B
issmooth = BooleanToggle(False)
srf = Surface(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)
extendsrfc = CSharpScript(srf=srf, north=north, east=east, south=south, west=west, isSmooth=issmooth)  # -> out, Srf; inputs srf: Surface, north: Double, east: Double, south: Double, west: Double, isSmooth: Boolean
# ---------- extendsrfc: C# ----------
    srf = srf.Extend(IsoStatus.North, north, isSmooth);
    srf = srf.Extend(IsoStatus.East, east, isSmooth);
    srf = srf.Extend(IsoStatus.South, south, isSmooth);
    srf = srf.Extend(IsoStatus.West, west, isSmooth);

    Srf = srf;
# ---------- end extendsrfc ----------

# ----
# Extend Surface - Example A
extend_dim = Slider(4, range=0..100)
issmooth_2 = BooleanToggle(False)
srf_2 = Surface(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)
extendsrfc_2 = CSharpScript(srf=srf_2, dim=extend_dim, isSmooth=issmooth_2)  # -> out, Srf; inputs srf: Surface, dim: Double, isSmooth: Boolean
# ---------- extendsrfc_2: C# ----------
    srf = srf.Extend(IsoStatus.North, dim, isSmooth);
    srf = srf.Extend(IsoStatus.East, dim, isSmooth);
    srf = srf.Extend(IsoStatus.South, dim, isSmooth);
    srf = srf.Extend(IsoStatus.West, dim, isSmooth);

    Srf = srf;
# ---------- end extendsrfc_2 ----------

south_2 = Slider(0, range=0..100)
east_2 = Slider(0, range=0..100)
west_2 = Slider(0, range=0..100)
north_2 = Slider(0, range=0..100)
issmooth_3 = BooleanToggle(False)
srf_3 = Surface(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)

# ----
# https://www.leonbrohmann.de/2022/07/08/rhino-gh-extend-surface-c-snippet/
panel_2 = Panel("Link")

extendsrfc_3 = CSharpScript(srf=srf_3, south=south_2, east=east_2, north=north_2, west=west_2, isSmooth=issmooth_3)  # -> out, Srf; inputs srf: Surface, south: Double, east: Double, north: Double, west: Double, isSmooth: Boolean
# ---------- extendsrfc_3: C# ----------
    srf = ExtendSurface(srf, north, IsoStatus.North, isSmooth);
    srf = ExtendSurface(srf, east, IsoStatus.East, isSmooth);
    srf = ExtendSurface(srf, west, IsoStatus.West, isSmooth);
    srf = ExtendSurface(srf, south, IsoStatus.South, isSmooth);

    Srf = srf;
# ---------- extendsrfc_3: C# additional code ----------
  Surface ExtendSurface(Surface srf, double val, IsoStatus status, bool isSmooth)
  {
    if (val != 0)
      srf = srf.Extend(status, val, isSmooth);

    return srf;
  }
# ---------- end extendsrfc_3 ----------
merge = Merge(Data1=south_2, Data2=east_2, Data3=north_2, Data4=west_2)

# ----
# A extend surface component written in c#
panel_3 = Panel("Summary")

# ----
# DisplaySurface
move = Move(Geometry=extendsrfc_3.Srf, Motion=Vector(0, 0, -3))  # -> Geometry, Transform
w = Slider(5, range=0..10)
merge_2 = Merge(Data1=move.Geometry, Data2=srf_3)
preview = CustomPreview(
    Geometry=move.Geometry,
    Material={diffuse=RGB(219, 219, 219), emission=RGB(66, 66, 66), shine=0.5, specular=RGB(255, 255, 255), transparency=0})
c_colour = CSharpScript(brps=merge_2, width=w, distances=merge)  # inputs brps: list of Brep, width: Int32, distances: list of Double
# ---------- c_colour: C# usings ----------
using System.Drawing;
# ---------- c_colour: C# ----------
    _width = width;
    _distances = distances;
    _brps = brps;
# ---------- c_colour: C# additional code ----------
  int _width;
  List<Brep> _brps;
  List<double> _distances;

  //What does override do?
  //https://www.geeksforgeeks.org/c-sharp-method-overriding/
  public override void DrawViewportMeshes(IGH_PreviewArgs args)
  {
    for (int i = 0; i < _brps.Count; i++)
    {
      Brep brp = _brps[i];

      bool brightness = (i == 0) ? true : false;

      ColorCurveAfterDistance(brp, args, 0, Color.CadetBlue, brightness);
      ColorCurveAfterDistance(brp, args, 1, Color.BlueViolet, brightness);
      ColorCurveAfterDistance(brp, args, 2, Color.DeepSkyBlue, brightness);
      ColorCurveAfterDistance(brp, args, 3, Color.RoyalBlue, brightness);
    }


  }

  private void ColorCurveAfterDistance(Brep brp, IGH_PreviewArgs args, int idx, Color c, bool ChangeBr)
  {
    double distVal = (ChangeBr == true) ? 0.8 / 150 * _distances[idx] : 0;
    Curve crv = brp.Edges[idx];
    Color c2 = ChangeColorBrightness(c, distVal);

    args.Display.DrawCurve(crv, c2, _width);
  }

  private  Color ChangeColorBrightness(Color color, double cFactor)
  {
    int r = GetColorBrightness(color.R, cFactor);
    int g = GetColorBrightness(color.G, cFactor);
    int b = GetColorBrightness(color.B, cFactor);

    return Color.FromArgb(color.A, r, g, b);
  }

  private int GetColorBrightness(byte _rgb, double cFactor)
  {
    double rgb = (double) _rgb;

    if (cFactor < 0)
      rgb *= 1 + cFactor;
    else
      rgb = (255 - rgb) * cFactor + rgb;

    if (rgb < 0)
      rgb = 0;
    else    if (rgb > 255)
      rgb = 255;

    return (int) rgb;
  }
# ---------- end c_colour ----------
preview_2 = CustomPreview(
    Geometry=srf_3,
    Material={diffuse=RGB(166, 166, 166), emission=RGB(50, 50, 50), shine=0.5, specular=RGB(255, 255, 255), transparency=0})
