# Grasshopper definition FilletCurveFromPolyLine.gh (Grasshopper 1.0.7)

author = CSharpScript()  # -> Output
# ---------- author: C# usings ----------
using System.IO;
using System.Linq;
using System.Data;
using System.Drawing;
using System.Reflection;
using System.Windows.Forms;
using System.Xml;
using System.Xml.Linq;
using System.Runtime.InteropServices;

using Rhino.DocObjects;
using Rhino.Collections;
using GH_IO;
using GH_IO.Serialization;
# ---------- author: C# ----------
    Output = new List<string>(){
        "Leon Brohmann",
        "Computational Designer",
        "leonbrohmann@gmx.de",
        "www.leonbrohmann.de"
        };
# ---------- author: C# additional code ----------
  //Draw all meshes in this method.
  public override void DrawViewportMeshes(IGH_PreviewArgs args)
  {
    Plane plane;
    args.Viewport.GetCameraFrame(out plane);

    Rectangle bounds = args.Viewport.Bounds;

    int width = 320;
    int height = 34;

    int distW = bounds.Width - width - 40;
    int distH = bounds.Height - height - 40;

    Color _color = ColorTranslator.FromHtml("#004187");

    args.Display.Draw2dRectangle(new Rectangle(distW, distH, width, height), Color.White, 0, Color.White);
    args.Display.Draw2dText("LEONBROHMANN.DE", Color.Black, new Point2d(distW + 4, distH + 7), false, 30);
  }
# ---------- end author ----------
panel = Panel(author)

# ----
# Geometry
crv = Curve(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)

move = Move(Geometry=crv, Motion=Vector(400, 0, 0))  # -> Geometry, Transform

# ----
# FilletCurveFromPolyLine
number_slider = Slider(34, range=0.1..200)
c_polyline_to_filletcurve = CSharpScript(pln=move.Geometry, radius=number_slider, tolerance=Slider(0.001, range=0.0001..0.1))  # -> out, FilletCrv; inputs pln: Polyline, radius: Double, tolerance: Double
# ---------- c_polyline_to_filletcurve: C# ----------
    List<Curve> crvs = new List<Curve>();
    List<Curve> crvJoined = new List<Curve>();

    int count = pln.SegmentCount;

    for (int i = 0; i < count; i++)
    {
      Line sgmA, sgmB;

      sgmA = pln.SegmentAt(i);

      if (i != pln.SegmentCount - 1)
        sgmB = pln.SegmentAt(i + 1);
      else // END
        sgmB = pln.SegmentAt(0);

      Point3d ptM_A = sgmA.PointAt(0.5);
      Point3d ptM_B = sgmB.PointAt(0.5);

      Curve crvA = sgmA.ToNurbsCurve();
      Curve crvB = sgmB.ToNurbsCurve();

      Curve crvSegmB = Curve.CreateFilletCurves
        (crvA, ptM_A, crvB, ptM_B, radius, false, false, false, tolerance, tolerance)[0];

      crvs.Add(crvSegmB);

      Curve crvSegmA = null;

      if (i != 0)
        crvSegmA = crvs[i - 1];

      //Join
      if (crvSegmA != null)
      {
        Curve ln = new Line(crvSegmA.PointAtEnd, crvSegmB.PointAtStart).ToNurbsCurve();
        crvJoined.Add(ln);
      }

      //Add First Curve
      if (i == count - 1)
      {
        Curve ln = new Line(crvSegmB.PointAtEnd, crvs[0].PointAtStart).ToNurbsCurve();
        crvJoined.Add(ln);
      }
    }

    crvs.AddRange(crvJoined);

    FilletCrv = Curve.JoinCurves(crvs, tolerance);
# ---------- end c_polyline_to_filletcurve ----------
panel_2 = Panel(c_polyline_to_filletcurve.FilletCrv)
crv_2 = Curve(c_polyline_to_filletcurve.FilletCrv)

# ----
# Creates a fillet curve from a polyline.
# 
# Uses:
# https://developer.rhino3d.com/api/RhinoCommon/html/M_Rhino_Geometry_Curve_CreateFilletCurves.htm
panel_3 = Panel("Summary")

relay = Relay([crv_2, crv])

# ----
# Color Curve
number_slider_2 = Slider(6, range=0..10)
c_colour = CSharpScript(width=number_slider_2, color=ColourSwatch(SwatchColor=RGB(51, 139, 255)), crvs=flatten(relay))  # inputs width: Int32, color: Color, crvs: tree of Curve
# ---------- c_colour: C# usings ----------
using System.Drawing;
# ---------- c_colour: C# ----------
    _width = width;
    _color = color;
    _crvs = crvs.AllData(); // DataTree<Curve> to List<Curve>
# ---------- c_colour: C# additional code ----------
  List<Curve> _crvs = new List<Curve>();
  Color _color;
  int _width;

  //What does override do?
  //https://www.geeksforgeeks.org/c-sharp-method-overriding/
  public override void DrawViewportMeshes(IGH_PreviewArgs args)
  {
    //Is needed, to clear Geometry after the component is diabled
    if (this.Component.Locked)
      _crvs.Clear();

    for (int i = 0; i < _crvs.Count; i++)
    {
      Curve crv = _crvs[i];
      args.Display.DrawCurve(crv, _color, _width);
    }
  }
# ---------- end c_colour ----------
