# Grasshopper definition groupBy_Linq.gh (Grasshopper 1.0.7)

author = CSharpScript()  # -> Output
# ---------- author: C# usings ----------
using System.IO;
using System.Linq;
using System.Data;
using System.Drawing;
using System.Reflection;
using System.Windows.Forms;
using System.Xml;
using System.Xml.Linq;
using System.Runtime.InteropServices;

using Rhino.DocObjects;
using Rhino.Collections;
using GH_IO;
using GH_IO.Serialization;
# ---------- author: C# ----------
    Output = new List<string>(){
        "Leon Brohmann",
        "Computational Designer",
        "leonbrohmann@gmx.de",
        "www.leonbrohmann.de"
        };
# ---------- author: C# additional code ----------
  //Draw all meshes in this method.
  public override void DrawViewportMeshes(IGH_PreviewArgs args)
  {
    Plane plane;
    args.Viewport.GetCameraFrame(out plane);

    Rectangle bounds = args.Viewport.Bounds;

    int width = 320;
    int height = 34;

    int distW = bounds.Width - width - 40;
    int distH = bounds.Height - height - 40;

    Color _color = ColorTranslator.FromHtml("#004187");

    args.Display.Draw2dRectangle(new Rectangle(distW, distH, width, height), Color.White, 0, Color.White);
    args.Display.Draw2dText("LEONBROHMANN.DE", Color.Black, new Point2d(distW + 4, distH + 7), false, 30);
  }
# ---------- end author ----------
panel = Panel(author)

# ----
# The Example groups the Values by the list of keys
# {0} is Scenario 1
# {1} is Scenario 2
keys = Panel("""Scenario 1
Scenario 2
Scenario 2
Scenario 2
Scenario 1""")
values = Panel("""Hello World
1
2
IceCream
0""")
c_sort = CSharpScript(Keys=keys, Values=values)  # -> out, A; inputs Keys: list, Values: list
# ---------- c_sort: C# usings ----------
using System.Linq;
# ---------- c_sort: C# ----------
    var res = Keys
      .Zip(Values, (keys, vals) => new {keys, vals})
      .GroupBy(pair => pair.keys, pair => pair.vals)
      .ToList();

    DataTree<object> tree = new DataTree<object>();

    for (int i = 0; i < res.Count; i++)
      tree.AddRange(res[i], new GH_Path(i));

    A = tree;
# ---------- end c_sort ----------
panel_2 = Panel(c_sort.A)

# ----
# https://dotnettutorials.net/lesson/groupby-in-linq/
# 
# What is LINQ?
# https://www.geeksforgeeks.org/linq-language-integrated-query/
panel_3 = Panel("Link")

# ----
# Does the same - but just with geometry
keys_2 = Panel("""1
2
2
2
1""")
pt = Point([Point(2.486685842, 1.107439772, 0.9340213597), Point(8.75821514, 7.961442879, 0.4404517982), Point(0.960044973, 9.516898365, 0.9651758973), Point(9.142282707, 0.9184793154, 1.504984329), Point(4.419897676, 6.225770733, 1.422511779)])
num = Number(keys_2)
c_sort_2 = CSharpScript(Keys=num, Values=pt)  # -> out, A; inputs Keys: list, Values: list; same code as c_sort
panel_4 = Panel(c_sort_2.A)
values_2 = Panel(pt)

# ----
# Using System.Linq and the GroupBy Method.  It takes a sequence of elements and then organizes the elements into groups.
panel_5 = Panel("Summary")
