# Grasshopper definition spotlight.gh (Grasshopper 1.0.7)

author = CSharpScript()  # -> Output
# ---------- author: C# usings ----------
using System.IO;
using System.Linq;
using System.Data;
using System.Drawing;
using System.Reflection;
using System.Windows.Forms;
using System.Xml;
using System.Xml.Linq;
using System.Runtime.InteropServices;

using Rhino.DocObjects;
using Rhino.Collections;
using GH_IO;
using GH_IO.Serialization;
# ---------- author: C# ----------
    Output = new List<string>(){
        "Leon Brohmann",
        "Computational Designer",
        "leonbrohmann@gmx.de",
        "www.leonbrohmann.de"
        };
# ---------- author: C# additional code ----------
  //Draw all meshes in this method.
  public override void DrawViewportMeshes(IGH_PreviewArgs args)
  {
    Plane plane;
    args.Viewport.GetCameraFrame(out plane);

    Rectangle bounds = args.Viewport.Bounds;

    int width = 320;
    int height = 34;

    int distW = bounds.Width - width - 40;
    int distH = bounds.Height - height - 40;

    Color _color = ColorTranslator.FromHtml("#004187");

    args.Display.Draw2dRectangle(new Rectangle(distW, distH, width, height), Color.White, 0, Color.White);
    args.Display.Draw2dText("LEONBROHMANN.DE", Color.Black, new Point2d(distW + 4, distH + 7), false, 30);
  }
# ---------- end author ----------
panel = Panel(author)

# ----
# SpotLight
number_slider = Slider(33, range=0..100)
color = ColourSwatch(SwatchColor=RGB(16, 125, 62))
pt = Point(Point(-4223.708921, 674.3007432, 3714.271399))
pt_2 = Point(Point(-594.5574419, 9203.525306, 2188.917324))
c_script = CSharpScript(
    color=color,
    pos=pt,
    focus=pt_2,
    deg=number_slider,
    hot=Slider(0.4, range=0..1),
    intens=Slider(3.7, range=0..10),
    shadow=Slider(1.4, range=0..10))  # -> out; inputs color: Color, pos: Point3d, focus: Point3d, deg: Double, hot: Double, intens: Double, shadow: Double
# ---------- c_script: C# usings ----------
using System.Linq;
using System.Drawing;
using Rhino.DocObjects;
# ---------- c_script: C# ----------
    string name = "GH_Light";

    LightObject lObj = GetLightObject(name);

    Light light = lObj.LightGeometry;

    light.LightStyle = LightStyle.WorldSpot;
    light.Diffuse = color;
    light.Location = pos;
    light.Direction = focus - pos;
    light.SpotAngleRadians = RhinoMath.ToRadians(deg);
    light.Intensity = intens;
    light.HotSpot = hot;
    light.ShadowIntensity = shadow;

    lObj.CommitChanges();
# ---------- c_script: C# additional code ----------
  //Gets Light - if no light with name - it creates a new
  LightObject GetLightObject(string name)
  {
    LightObject lObj = GetLightByName(name);

    Light light;

    if (lObj == null)
    {
      light = new Light();
      light.Name = name;

      int idx = RhinoDocument.Lights.Add(light);
    }

    lObj = GetLightByName(name);

    return lObj;
  }

  //Return null when no light was found
  LightObject GetLightByName(string name)
  {
    return RhinoDocument.Lights.FirstOrDefault(q => q.Name == name && !q.IsDeleted);
  }
# ---------- end c_script ----------

# ----
# Creates a Spotlight object in Rhino with C# in Grasshopper/ Rhino
panel_2 = Panel("Summary")
