# Grasshopper definition Loops_For.gh (Grasshopper 1.0.7)

author = CSharpScript()  # -> Output
# ---------- author: C# usings ----------
using System.IO;
using System.Linq;
using System.Data;
using System.Drawing;
using System.Reflection;
using System.Windows.Forms;
using System.Xml;
using System.Xml.Linq;
using System.Runtime.InteropServices;

using Rhino.DocObjects;
using Rhino.Collections;
using GH_IO;
using GH_IO.Serialization;
# ---------- author: C# ----------
    Output = new List<string>(){
        "Leon Brohmann",
        "Computational Designer",
        "leonbrohmann@gmx.de",
        "www.leonbrohmann.de"
        };
# ---------- author: C# additional code ----------
  //Draw all meshes in this method.
  public override void DrawViewportMeshes(IGH_PreviewArgs args)
  {
    Plane plane;
    args.Viewport.GetCameraFrame(out plane);

    Rectangle bounds = args.Viewport.Bounds;

    int width = 320;
    int height = 34;

    int distW = bounds.Width - width - 40;
    int distH = bounds.Height - height - 40;

    Color _color = ColorTranslator.FromHtml("#004187");

    args.Display.Draw2dRectangle(new Rectangle(distW, distH, width, height), Color.White, 0, Color.White);
    args.Display.Draw2dText("LEONBROHMANN.DE", Color.Black, new Point2d(distW + 4, distH + 7), false, 30);
  }
# ---------- end author ----------
panel = Panel(author)

# ----
# 6. Point row
incr = Slider(1, range=1..10)
start = Slider(0, range=0..10)
end = Slider(5, range=0..10)
c_script = CSharpScript(start=start, end=end, incr=incr)  # -> out, A; inputs start: Int32, end: Int32, incr: Int32
# ---------- c_script: C# ----------
    List<Point3d> lst = new List<Point3d>();

    for (int i = start; i < end; i += incr)
    {
      Point3d pt = new Point3d(i, 0, 0);
      lst.Add(pt);
    }

    A = lst;
# ---------- end c_script ----------
output_a = Panel(c_script.A)

# ----
# 7. Loop in a loop
start_2 = Slider(2, range=0..10)
end_2 = Slider(2, range=0..10)
c_script_2 = CSharpScript(a=start_2, b=end_2)  # -> out, A; inputs a: Int32, b: Int32
# ---------- c_script_2: C# ----------
    List<string> lst = new List<string>();
 
    for (int i = 0; i < a; i++)
    {
      for (int u = 0; u < b; u++)
      {
        lst.Add("Value {i,u} = {" + i + "," + u + "}");
      }
    }
 
    A = lst;
# ---------- end c_script_2 ----------
output_a_2 = Panel(c_script_2.A)

# ----
# 9. Point Datatree
endy = Slider(4, range=1..10)
starty = Slider(0, range=0..10)
endx = Slider(3, range=0..10)
incrx = Slider(1, range=1..10)
starty_2 = Slider(0, range=0..10)
incry = Slider(1, range=1..10)
c_script_3 = CSharpScript(startX=starty, endX=endx, incrX=incrx, startY=starty_2, endY=endy, incrY=incry)  # -> out, A; inputs startX: Int32, endX: Int32, incrX: Int32, startY: Int32, endY: Int32, incrY: Int32
# ---------- c_script_3: C# ----------
    DataTree<Point3d> tree = new DataTree<Point3d>();

    for (int i = startX; i < endX; i += incrX)
    {
      GH_Path pth = new GH_Path(i);

      for (int u = startY; u < endY; u += incrY)
      {
        Point3d pt = new Point3d(i, u, 0);
        tree.Add(pt, pth);
      }
    }

    A = tree;
# ---------- end c_script_3 ----------
output_a_3 = Panel(c_script_3.A)

# ----
# 5. Loop with input
start_3 = Slider(1, range=0..10)
end_3 = Slider(10, range=0..10)
incr_2 = Slider(2, range=1..10)
c_script_4 = CSharpScript(start=start_3, end=end_3, incr=incr_2)  # -> out, A; inputs start: Int32, end: Int32, incr: Int32
# ---------- c_script_4: C# ----------
    List<int> lst = new List<int>();

    for (int i = start; i < end; i += incr)
    {
      lst.Add(i);
    }

    A = lst;
# ---------- end c_script_4 ----------
output_a_4 = Panel(c_script_4.A)

# ----
# 8. Point grid
incrx_2 = Slider(1, range=1..10)
starty_3 = Slider(0, range=0..10)
endx_2 = Slider(4, range=0..10)
starty_4 = Slider(0, range=0..10)
endy_2 = Slider(2, range=1..10)
incry_2 = Slider(1, range=0..10)
c_script_5 = CSharpScript(startX=starty_3, endX=endx_2, incrX=incrx_2, startY=starty_4, endY=endy_2, incrY=incry_2)  # -> out, A; inputs startX: Int32, endX: Int32, incrX: Int32, startY: Int32, endY: Int32, incrY: Int32
# ---------- c_script_5: C# ----------
    List<Point3d> lst = new List<Point3d>();

    for (int i = startX; i < endX; i += incrX)
    {
      for (int u = startY; u < endY; u += incrY)
      {
        Point3d pt = new Point3d(i, u, 0);
        lst.Add(pt);
      }
    }

    A = lst;
# ---------- end c_script_5 ----------
output_a_5 = Panel(c_script_5.A)

# ----
# 0. Why we need Loops
c_script_6 = CSharpScript()  # -> out, A
# ---------- c_script_6: C# ----------
    List<Point3d> pts = new List<Point3d>();

    Point3d pt0 = new Point3d(0, 0, 0);
    pts.Add(pt0);

    Point3d pt1 = new Point3d(1, 0, 0);
    pts.Add(pt1);

    Point3d pt2 = new Point3d(2, 0, 0);
    pts.Add(pt2);
    //...
    Point3d pt6 = new Point3d(5, 0, 0);
    pts.Add(pt6);

    //Output
    A = pts;
# ---------- end c_script_6 ----------
output_a_6 = Panel(c_script_6.A)

# ----
# 1. Count
c_script_7 = CSharpScript()  # -> out, A
# ---------- c_script_7: C# ----------
    int count = 0;

    for (int i = 0; i < 5; i++)
    {
      count++;
    }

    A = count;
# ---------- end c_script_7 ----------
output_a_7 = Panel(c_script_7.A)

# ----
# 2. ++ Iterator
c_script_8 = CSharpScript()  # -> out, A
# ---------- c_script_8: C# ----------
    List<int> lst = new List<int>();

    for (int i = 0; i < 5; i++)
    {
      lst.Add(i);
    }

    A = lst;
# ---------- end c_script_8 ----------
output_a_8 = Panel(c_script_8.A)

# ----
# 3. -- Iterator
c_script_9 = CSharpScript()  # -> out, A
# ---------- c_script_9: C# ----------
    List<int> lst = new List<int>();

    for (int i = 3; i >= 0; i--)
    {
      lst.Add(i);
    }

    A = lst;
# ---------- end c_script_9 ----------
output_a_9 = Panel(c_script_9.A)

# ----
# 4. += Iterator
c_script_10 = CSharpScript()  # -> out, A
# ---------- c_script_10: C# ----------
    List<int> lst = new List<int>();

    for (int i = 0; i < 5; i += 2)
    {
      lst.Add(i);
    }

    A = lst;
# ---------- end c_script_10 ----------
output_a_10 = Panel(c_script_10.A)

# ----
# Loops, also called recursions, can repeat a block of code until a special condition is reached. They are useful as they save time, reduce errors, make the code shorter and more readable.
panel_2 = Panel("Explanation")

# ----
# This File belongs to How To:
# C# Scripting Basics in Grasshopper
# 
# Part1:
# https://www.leonbrohmann.de/2021/08/14/rhino-gh-c-scripting-basics-loops1/
# 
# Part2:
# https://www.leonbrohmann.de/2022/01/31/rhino-gh-c-scripting-basics-for-loops-part-2/
panel_3 = Panel("About / Link")

# ----
# Switch
# Example
list = ValueList({"Example 0": 0, "Example 6": 1, "Example 8": 2, "Example 9": 3}, selected="Example 0")

# ----
# Visualisation
number_slider = Slider(10, range=0..100)
filter = StreamFilter(Gate=list, Stream0=c_script_6.A, Stream1=c_script.A, Stream2=c_script_5.A, Stream3=c_script_3.A)  # -> flatten(Stream)
c_script_11 = CSharpScript(color=ColourSwatch(SwatchColor=RGB(255, 0, 0)), pts=filter, size=number_slider)  # inputs color: Color, pts: list of Point3d, size: Int32
# ---------- c_script_11: C# usings ----------
using System.Drawing;
# ---------- c_script_11: C# ----------
    _pts.Clear();

    if (Component.Hidden)
      return;

    if (pts.Count == 0)
      return;

    _color = color;
    _pts = pts;
    _size = size;
# ---------- c_script_11: C# additional code ----------
  List<Point3d> _pts = new List<Point3d>();
  Color _color;
  int _size;

  public override void DrawViewportMeshes(IGH_PreviewArgs args)
  {
    if (_pts.Count == 1 && _pts[0] == Point3d.Origin)
      return;

    string hex = "#fd5d3d";
    _color = ColorTranslator.FromHtml(hex);

    args.Display.DrawPoints(_pts, Rhino.Display.PointStyle.X, _size, _color);
  }
# ---------- end c_script_11 ----------
