# Grasshopper definition PointOnCircle.gh (Grasshopper 1.0.7)

number_slider = Slider(12, range=0..100)
number_slider_2 = Slider(51, range=0..360)

author = CSharpScript()  # -> Output
# ---------- author: C# usings ----------
using System.IO;
using System.Linq;
using System.Data;
using System.Drawing;
using System.Reflection;
using System.Windows.Forms;
using System.Xml;
using System.Xml.Linq;
using System.Runtime.InteropServices;

using Rhino.DocObjects;
using Rhino.Collections;
using GH_IO;
using GH_IO.Serialization;
# ---------- author: C# ----------
    Output = new List<string>(){
        "Leon Brohmann",
        "Computational Designer",
        "leonbrohmann@gmx.de",
        "www.leonbrohmann.de"
        };
# ---------- author: C# additional code ----------
  //Draw all meshes in this method.
  public override void DrawViewportMeshes(IGH_PreviewArgs args)
  {
    Plane plane;
    args.Viewport.GetCameraFrame(out plane);

    Rectangle bounds = args.Viewport.Bounds;

    int width = 320;
    int height = 34;

    int distW = bounds.Width - width - 40;
    int distH = bounds.Height - height - 40;

    Color _color = ColorTranslator.FromHtml("#004187");

    args.Display.Draw2dRectangle(new Rectangle(distW, distH, width, height), Color.White, 0, Color.White);
    args.Display.Draw2dText("LEONBROHMANN.DE", Color.Black, new Point2d(distW + 4, distH + 7), false, 30);
  }
# ---------- end author ----------
panel = Panel(author)

# ----
# Calculate a Point on a Circle in C#
# 
# Source:
# https://stackoverflow.com/questions/839899/how-do-i-calculate-a-point-on-a-circle-s-circumference
panel_2 = Panel("Summary")

# ----
# Point on a Circle
pointoncurve = CSharpScript(radius=number_slider, deg=number_slider_2)  # -> out, A; inputs radius: Double, deg: Double
# ---------- pointoncurve: C# ----------
    A = PtOnCircle(radius, deg, Point3d.Origin);
# ---------- pointoncurve: C# additional code ----------
  // https://stackoverflow.com/questions/839899/how-do-i-calculate-a-point-on-a-circle-s-circumference
 
  public Point3d PtOnCircle(double radius, double angle, Point3d origin)
  {
    double val = -(angle - 90) * Math.PI / 180;

    double x = (radius * Math.Cos(val)) + origin.X;
    double y = (radius * Math.Sin(val)) + origin.Y;

    return new Point3d(x, y, 0);
  }
# ---------- end pointoncurve ----------

# ----
# Visualisation
number_slider_3 = Slider(5, range=0..100)
cir = Circle(Plane=PlaneXY(0, 0, 0), Radius=number_slider)
addition = Addition(A=number_slider, B=number_slider_3)
pointoncurve_2 = CSharpScript(radius=addition, deg=number_slider_2)  # -> out, A; inputs radius: Double, deg: Double; same code as pointoncurve
concat = Concatenate(FragmentA=number_slider_2, FragmentB=" Deg")
tag = TextTag(Location=pointoncurve_2.A, Text=concat)
