# Grasshopper definition Noise Brick Wall.gh (Grasshopper 1.0.8)
# plug-ins: treesloth01
# An algorithm to create a dual material brick wall, based on smooth value noise.

# ----
# Line Geometry
number_slider = Slider(9000, range=0..10000)
pt = ConstructPoint(XCoordinate=0, YCoordinate=0, ZCoordinate=0)
line = LineSDL(Start=pt, Direction=Vector(1, 0, 0), Length=number_slider)

# ----
# Curve Geometry
crv = Curve(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)

height = Slider(90, range=0..100)

multiplication = Multiplication(A=Slider(3200, range=0..10000), B=Slider(3, range=0..10))
Z = UnitZ(Factor=multiplication)
extr = Extrude(Base=crv, Direction=Z)

# ----
# Row Crvs
# Creating Simple rows
# with a certain distance
contour = Contour(Shape=extr, Point=pt, Direction=Vector(0, 0, 1), Distance=height)

# ----
# Point Grid
# Lazy weaving points to a grid...
# For sure could be prettier.
number_slider_2 = Slider(115, range=0..1000)
division = Division(A=number_slider_2, B=2)
divlength = DivideLength(Curve=contour, Length=division)  # -> simplify(Points), Tangents, Parameters
split = SplitTree(Data=divlength.Points, Masks=flatten("{0,2,...}"))  # -> Positive, Negative
panel = Panel("""0
1""")
cull = CullPattern(List=split.Negative, CullPattern=invert(panel))
item = ListItem(List=split.Positive, Index=0, Wrap=True)
item_2 = ListItem(List=split.Positive, Index=-1, Wrap=True)
item_3 = ListItem(List=split.Negative, Index=0, Wrap=True)
cull_2 = CullPattern(List=split.Positive, CullPattern=panel)
item_4 = ListItem(List=split.Negative, Index=-1, Wrap=True)
merge = Merge(Data1=item, Data2=cull_2, Data3=item_2, Data4=item_3, Data5=cull, Data6=item_4)
duppt = RemoveDuplicatePts(Points=merge, Tolerance=0.01)

# ----
# Creating brick base line
# Creating oriented lines ro represent bricks
mortargap = Slider(5, range=0..10)
cull_i = CullIndex(List=duppt, Indices=-1, Wrap=True)
cull_i_2 = CullIndex(List=duppt, Indices=0, Wrap=True)
addition = Addition(A=mortargap, B=mortargap, C=" 0.1")
ln = Line(StartPoint=cull_i, EndPoint=cull_i_2)
larger = LargerThan(FirstNumber=ln, SecondNumber=addition)  # -> LargerThan, OrEqualTo
cull_3 = CullPattern(List=ln, CullPattern=larger.LargerThan)
ext = ExtendCurve(Curve=cull_3, Type=0, Start=expr("-x", mortargap), End=expr("-x", mortargap))  # -> reparameterize(Curve)
eval = EvaluateCurve(Curve=ext, Parameter=0.5)  # -> Point, Tangent, Angle

# ----
# Maps distance to 0-1 Domain
# Remap distances
crv_cp = CurveClosestPoint(Point=eval.Point, Curve=crv)  # -> Point, Parameter, Distance
bnd = Bounds(Numbers=flatten(crv_cp.Distance))
remap = RemapNumbers(Value=crv_cp.Distance, Source=bnd, Target=Domain(0, 1))  # -> simplify(Mapped), Clipped

# ----
# Randomise Numbers
number_slider_3 = Slider(0.251, range=0..1)
lng = ListLength(List=flatten(remap.Mapped))
dom = ConstructDomain(DomainStart=expr("-x", number_slider_3), DomainEnd=number_slider_3)
random = Random(Range=dom, Number=lng, Seed=2)  # -> simplify(Random)
panel_2 = Panel(" Creates random noise")
c_repl_fast = CSharpScript(xTree=remap.Mapped, yList=random)  # -> out, a; inputs xTree: tree, yList: list
# ---------- c_repl_fast: C# ----------
// Grasshopper Script Instance
#region Usings
using System;
using System.Linq;
using System.Collections;
using System.Collections.Generic;
using System.Drawing;

using Rhino;
using Rhino.Geometry;

using Grasshopper;
using Grasshopper.Kernel;
using Grasshopper.Kernel.Data;
using Grasshopper.Kernel.Types;
#endregion

public class Script_Instance : GH_ScriptInstance
{
// Does the same as the Replace component - in super fast. Works just in this case

    private void RunScript(DataTree<object> xTree, List<object> yList, ref object a)
    {
        int count = 0;
        DataTree<object> result = new DataTree<object>();

        for (int i = 0; i < xTree.Paths.Count; i++) 
        {
            GH_Path pth = xTree.Paths[i];

            List<object> branch = xTree.Branch(pth);

             for (int u = 0; u < branch.Count; u++) 
            {
                var obj = yList[count];

                GH_Path rPth = new GH_Path(pth[0],u);
                result.Add(obj,rPth);

                count ++;
            }
        }
        a = result;
    }
}
# ---------- end c_repl_fast ----------

# ----
# Smooth
# Value noise
number_slider_4 = Slider(13, range=0..20)
crv_cp_2 = CurveClosestPoint(Point=simplify(eval.Point), Curve=reparameterize(simplify(contour)))  # -> Point, Parameter, Distance
c_smooth_value_noise = CSharpScript(
    P=simplify(eval.Point),
    T=crv_cp_2.Parameter,
    ScaleU=number_slider_4,
    ScaleV=Slider(7, range=0..20),
    Seed=Slider(5, range=0..10))  # -> out, A, simplify(N); inputs P: tree of Point3d, T: tree of Double, ScaleU: Double, ScaleV: Double, Seed: Int32
# ---------- c_smooth_value_noise: C# ----------
using System;
using System.Collections.Generic;

using Rhino.Geometry;

using Grasshopper.Kernel.Data;
using Grasshopper;

public class Script_Instance : GH_ScriptInstance
{
    // 2D smooth value noise - generated via AI
    private void RunScript(
		DataTree<Point3d> P,
		DataTree<double> T,
		double ScaleU,
		double ScaleV,
		int Seed,
		ref object A,
		ref object N)
    {
        ScaleU = Math.Max(0.000001, ScaleU);
        ScaleV = Math.Max(0.000001, ScaleV);

        DataTree<Point3d> result = new DataTree<Point3d>();
        DataTree<double> noiseValues = new DataTree<double>();

        int branchCount = P.BranchCount;

        for (int b = 0; b < branchCount; b++)
        {
            GH_Path path = P.Path(b);

            List<Point3d> points = P.Branch(b);
            List<double> parameters = T.Branch(path);

            int count = Math.Min(points.Count, parameters.Count);

            // Normalize row position.
            // First branch = 0, Last branch  = 1
            double rowPosition = 0.0;

            if (branchCount > 1)
                rowPosition = b / (double)(branchCount - 1);

            // Create V noise coordinate.
            double v = rowPosition * ScaleV;

            for (int i = 0; i < count; i++)
            {
                Point3d pt = points[i];

                double t = parameters[i];

                // Clamp T just for safety.
                t = Math.Clamp(t, 0.0, 1.0);

                // ScaleU = number of noise regions along the curves
                // ScaleV = number of noise regions across the rows
                double u = t * ScaleU;

                // Evaluate smooth 2D noise
                double noise = ValueNoise2D( u, v, Seed);

                // Apply displacement in world Z
                Point3d moved = pt;
                moved.Z += noise;


                // Preserve original tree structure.
                result.Add(moved, path);
                noiseValues.Add(noise, path);
            }
        }

        // OUTPUT
        A = result;
        N = noiseValues;
    }

    /// 2D SMOOTH VALUE NOISE
    /// Creates continuous deterministic noise from X/Y coordinates.
    /// Approximate output: -1 - +1
    private double ValueNoise2D(double x, double y, int seed)
    {
        // Integer noise-cell coordinates.
        int x0 = (int)Math.Floor(x);
        int y0 = (int)Math.Floor(y);

        int x1 = x0 + 1;
        int y1 = y0 + 1;

        // Position inside the current cell.
        double tx = x - x0;
        double ty = y - y0;

        // Smooth interpolation factors.
        double sx = Fade(tx);
        double sy = Fade(ty);

        // Random deterministic values at the four cell corners.
        double n00 = Hash(x0, y0, seed);
        double n10 = Hash(x1, y0, seed);

        double n01 = Hash(x0, y1, seed);
        double n11 = Hash(x1, y1, seed);

        // Interpolate horizontally.
        double nx0 = double.Lerp( n00,n10, sx);
        double nx1 = double.Lerp( n01, n11,sx);

        // Interpolate vertically.
        return double.Lerp( nx0, nx1, sy);
    }

    /// DETERMINISTIC HASH
    /// Creates a repeatable pseudo-random value from:
    /// Returns: -1 - +1
    private double Hash( int x, int y, int seed)
    {
        unchecked
        {
            uint h = 2166136261u;

            h = (h ^ (uint)x) * 16777619u;
            h = (h ^ (uint)y) * 16777619u;
            h = (h ^ (uint)seed) * 16777619u;

            // Additional scrambling.
            h += h << 13;
            h ^= h >> 7;

            h += h << 3;
            h ^= h >> 17;

            h += h << 5;

            // Convert uint to 0...1.
            double value = h / (double)uint.MaxValue;

            // Convert to -1...1.
            return value * 2.0 - 1.0;
        }
    }

    /// Gives smooth transitions between noise cells. Perlin noise fade
    private double Fade(double t)=>  t * t * t *( t * ( t * 6.0 - 15.0) + 10.0);
}
# ---------- end c_smooth_value_noise ----------
dom_2 = ConstructDomain(DomainStart=expr("-x", Slider(0.1, range=0..1)), DomainEnd=Slider(0.139, range=0..1))
remap_2 = RemapNumbers(Value=c_smooth_value_noise.N, Source=Domain(0, 1), Target=dom_2)  # -> graft(Mapped), Clipped

# ----
# Graphmapper for
# more control
graph = GraphMapper(
    remap.Mapped,
    x0=0,
    x1=1,
    y0=0,
    y1=1,
    container_name="Bezier",
    cpx=[0, 0.6118765473, 0.5626308918, 1],
    cpy=[0, 0.04573857784, 0.6264982224, 1])
data = Data(simplify(graft(graph)))

# ----
# Boolean Pattern
addition_2 = Addition(A=remap_2.Mapped, B=data, C=c_repl_fast.a)
B = Slider(0.5, range=0..1)
shift = ShiftPaths(Data=addition_2, Offset=-1)  # -> simplify(Data)
larger_2 = LargerThan(FirstNumber=shift, SecondNumber=B)  # -> simplify(LargerThan), OrEqualTo

# ----
# Creates 2 optimised Meshes,
# which can be updated rapidly.
# 
# Half assed optimised!
# Brick generator
number_slider_5 = Slider(70, range=0..100)
len = Length(Curve=ext)
subtraction = Subtraction(A=height, B=Slider(10, range=0..10))
c_brickinator_9000 = CSharpScript(
    Point=simplify(eval.Point),
    T=simplify(eval.Tangent),
    Length=simplify(len),
    Height=subtraction,
    Depth=number_slider_5,
    P=simplify(larger_2.LargerThan))  # -> out, MeshesA, MeshesB; inputs Point: tree of Point3d, T: tree of Vector3d, Length: tree of Double, Height: Double, Depth: Double, P: tree of Boolean
# ---------- c_brickinator_9000: C# ----------
#region Usings
using System;
using System.Collections.Generic;
using Rhino;
using Rhino.Geometry;
using Grasshopper;
using Grasshopper.Kernel.Data;
#endregion


public class Script_Instance : GH_ScriptInstance
{
    // Persistens Row Cache
    private readonly List<RowCache> _rows = new List<RowCache>();

    private void RunScript(
		DataTree<Point3d> Point,
		DataTree<Vector3d> T,
		DataTree<double> Length,
		double Height,
		double Depth,
		DataTree<bool> P,
		ref object MeshesA,
		ref object MeshesB)
    {
        DataTree<Mesh> resultA = new DataTree<Mesh>();
        DataTree<Mesh> resultB = new DataTree<Mesh>();

        int branchCount = Point.BranchCount;

        // Resize persistent cache to branch count
        while (_rows.Count < branchCount)
            _rows.Add(null);

        if (_rows.Count > branchCount)
            _rows.RemoveRange( branchCount,  _rows.Count - branchCount );

        // Ürocess Rows
        for (int b = 0; b < branchCount; b++)
        {
            GH_Path path = Point.Path(b);

            List<Point3d> points = Point.Branch(b);
            List<Vector3d> tangents = T.Branch(b);
            List<double> lengths = Length.Branch(b);
            List<bool> pattern = P.Branch(b);

            int count = points.Count;

            // Hash pattern + geometry
            ulong patternHash = HashPattern(pattern);
            ulong geometryHash =  HashGeometry(  points, tangents, lengths,  Height,  Depth );

            RowCache row = _rows[b];

            // NEW ROW / DIFFERENT PATH
            if (row == null || row.Path == null || !row.Path.Equals(path))
            {
                row = new RowCache();

                row.Path = path;
                _rows[b] = row;

                BuildRow(  row,  points,tangents, lengths, pattern, Height, Depth);

                row.PatternHash = patternHash;
                row.GeometryHash = geometryHash;
            }

            // PATTERN CHANGED
            // A/B topology for THIS ROW must be rebuilt.
            else if (row.ItemCount != count || row.PatternHash != patternHash)
            {
                BuildRow(row,points,tangents,lengths,pattern,Height, Depth);

                row.PatternHash = patternHash;
                row.GeometryHash = geometryHash;
            }

            // ONLY GEOMETRY CHANGED
            // Keep topology, only move existing vertices.
            else if (row.GeometryHash != geometryHash)
            {
                UpdateRowGeometry( row,points,tangents,lengths, Height,Depth);
                row.GeometryHash = geometryHash;
            }

            // OUTPUT
            resultA.EnsurePath(path);
            resultB.EnsurePath(path);

            if (row.MeshA != null)
                resultA.Add(row.MeshA, path);

            if (row.MeshB != null)
                resultB.Add(row.MeshB, path);
        }

        MeshesA = resultA;
        MeshesB = resultB;
    }

    /// Rebuilds only one row when its A/B pattern changes.
    private void BuildRow(RowCache row, List<Point3d> points, List<Vector3d> tangents,List<double> lengths,List<bool> pattern,double height, double depth)
    {
        int count = points.Count;
        int countA = 0;

        for (int i = 0; i < count; i++)
        {
            if (pattern[i])
                countA++;
        }

        int countB = count - countA;

        row.ItemCount = count;

        row.IsA = new bool[count];
        row.Slot = new int[count];

        // New valid topology only for required bricks
        row.MeshA = countA > 0 ? CreateBrickMesh(countA) : null;
        row.MeshB = countB > 0 ? CreateBrickMesh(countB) : null;

        // Map original row item -> location inside A or B mesh
        int indexA = 0;
        int indexB = 0;

        for (int i = 0; i < count; i++)
        {
            bool isA = pattern[i];

            row.IsA[i] = isA;

            if (isA)
                row.Slot[i] = indexA++;
            else
                row.Slot[i] = indexB++;
        }

        // Populate geometry
        UpdateRowGeometry( row, points, tangents, lengths,height, depth);
    }

    /// Updates geometry while preserving existing A/B topology.
    private void UpdateRowGeometry(RowCache row, List<Point3d> points,List<Vector3d> tangents,List<double> lengths,double height,double depth)
    {
        for (int i = 0; i < points.Count; i++)
        {
            Mesh mesh = row.IsA[i] ? row.MeshA: row.MeshB;

            if (mesh == null)
                continue;

            SetBrick( mesh, row.Slot[i], points[i], tangents[i], Math.Abs(lengths[i]), height, depth );
        }

        // Independent face vertices = hard brick edges.
        // Compute normals only for this changed row.

        if (row.MeshA != null)
            row.MeshA.Normals.ComputeNormals();

        if (row.MeshB != null)
            row.MeshB.Normals.ComputeNormals();
    }

    /// Creates topology for N complete valid bricks.
    /// 24 vertices + 6 quads per brick.
    private Mesh CreateBrickMesh(int count)
    {
        Mesh mesh = new Mesh();

        int vertexCount = count * 24;

        mesh.Vertices.Capacity = vertexCount;
        mesh.Faces.Capacity = count * 6;

        for (int i = 0; i < vertexCount; i++)
            mesh.Vertices.Add(0, 0, 0);

        for (int i = 0; i < count; i++)
        {
            int v = i * 24;

            mesh.Faces.AddFace(v,      v + 1,  v + 2,  v + 3);
            mesh.Faces.AddFace(v + 4,  v + 5,  v + 6,  v + 7);
            mesh.Faces.AddFace(v + 8,  v + 9,  v + 10, v + 11);
            mesh.Faces.AddFace(v + 12, v + 13, v + 14, v + 15);
            mesh.Faces.AddFace(v + 16, v + 17, v + 18, v + 19);
            mesh.Faces.AddFace(v + 20, v + 21, v + 22, v + 23);
        }

        return mesh;
    }

    /// Updates one complete brick inside a combined row mesh.
    /// X = Tangent, Y = Depth, Z = Height.
    private void SetBrick( Mesh mesh, int brickIndex,  Point3d center, Vector3d tangent, double length, double height, double depth)
    {
        // Local X
        Vector3d x = tangent;

        if (!x.Unitize())
            x = Vector3d.XAxis;

        // Local Z: world Z projected perpendicular to X
        Vector3d z = Vector3d.ZAxis - x * (Vector3d.ZAxis * x);

        if (!z.Unitize())
        {
            z = Vector3d.YAxis - x * (Vector3d.YAxis * x);
            z.Unitize();
        }

        // Local Y
        Vector3d y = Vector3d.CrossProduct(z, x);
        y.Unitize();

        Vector3d lx = x * (length * 0.5);
        Vector3d dy = y * (depth * 0.5);
        Vector3d hz = z * (height * 0.5);

        // Eight corners
        Point3d p000 = center - lx - dy - hz;
        Point3d p100 = center + lx - dy - hz;
        Point3d p110 = center + lx + dy - hz;
        Point3d p010 = center - lx + dy - hz;

        Point3d p001 = center - lx - dy + hz;
        Point3d p101 = center + lx - dy + hz;
        Point3d p111 = center + lx + dy + hz;
        Point3d p011 = center - lx + dy + hz;

        int v = brickIndex * 24;

        // Six independent faces
        SetQuad(mesh, v,      p000, p010, p110, p100); // Bottom
        SetQuad(mesh, v + 4,  p001, p101, p111, p011); // Top
        SetQuad(mesh, v + 8,  p000, p100, p101, p001); // Front
        SetQuad(mesh, v + 12, p010, p011, p111, p110); // Back
        SetQuad(mesh, v + 16, p000, p001, p011, p010); // Left
        SetQuad(mesh, v + 20, p100, p110, p111, p101); // Right
    }

    /// Writes one quad into four existing vertex slots.
    private void SetQuad( Mesh mesh, int v, Point3d a, Point3d b,  Point3d c, Point3d d)
    {
        mesh.Vertices.SetVertex(v,     a.X, a.Y, a.Z);
        mesh.Vertices.SetVertex(v + 1, b.X, b.Y, b.Z);
        mesh.Vertices.SetVertex(v + 2, c.X, c.Y, c.Z);
        mesh.Vertices.SetVertex(v + 3, d.X, d.Y, d.Z);
    }

    /// Creates a fast signature for the A/B pattern of one row.
    private ulong HashPattern(List<bool> pattern)
    {
        unchecked
        {
            ulong hash = 1469598103934665603UL;

            for (int i = 0; i < pattern.Count; i++)
            {
                hash ^= pattern[i] ? 1UL : 0UL;
                hash *= 1099511628211UL;
            }

            return hash;
        }
    }

    /// Creates a signature for all geometry-driving values of one row.
    /// If unchanged, the cached row geometry can be reused completely.
    private ulong HashGeometry( List<Point3d> points, List<Vector3d> tangents, List<double> lengths, double height, double depth)
    {
        ulong hash = 1469598103934665603UL;

        HashDouble(ref hash, height);
        HashDouble(ref hash, depth);

        for (int i = 0; i < points.Count; i++)
        {
            Point3d p = points[i];
            Vector3d t = tangents[i];

            HashDouble(ref hash, p.X);
            HashDouble(ref hash, p.Y);
            HashDouble(ref hash, p.Z);
            HashDouble(ref hash, t.X);
            HashDouble(ref hash, t.Y);
            HashDouble(ref hash, t.Z);
            HashDouble(ref hash, lengths[i]);
        }

        return hash;
    }

    /// Adds one double value to an FNV-1a hash.
    /// Overflow is intentional.
    private void HashDouble(ref ulong hash, double value)
    {
        unchecked
        {
            ulong bits = (ulong)BitConverter.DoubleToInt64Bits(value);

            hash ^= bits;
            hash *= 1099511628211UL;
        }
    }

    /// Persistent information belonging to one Grasshopper branch.
    private class RowCache
    {
        public GH_Path Path;

        public Mesh MeshA;
        public Mesh MeshB;

        public bool[] IsA;
        public int[] Slot;

        public int ItemCount;

        public ulong PatternHash;
        public ulong GeometryHash;
    }
}
# ---------- end c_brickinator_9000 ----------

# ----
# Display
swatch = ColourSwatch(SwatchColor=RGBA(158, 158, 158, 145))
preview = CustomPreview(Geometry=c_brickinator_9000.MeshesA, Material=ColourSwatch(SwatchColor=RGB(194, 101, 47)))
preview_2 = CustomPreview(Geometry=c_brickinator_9000.MeshesB, Material=swatch)
