# Grasshopper definition Circular.gh (Grasshopper 1.0.7)

author = CSharpScript()  # -> Output
# ---------- author: C# usings ----------
using System.IO;
using System.Linq;
using System.Data;
using System.Drawing;
using System.Reflection;
using System.Windows.Forms;
using System.Xml;
using System.Xml.Linq;
using System.Runtime.InteropServices;

using Rhino.DocObjects;
using Rhino.Collections;
using GH_IO;
using GH_IO.Serialization;
# ---------- author: C# ----------
    Output = new List<string>(){
        "Leon Brohmann",
        "Computational Designer",
        "leonbrohmann@gmx.de",
        "www.leonbrohmann.de"
        };
# ---------- author: C# additional code ----------
  //Draw all meshes in this method.
  public override void DrawViewportMeshes(IGH_PreviewArgs args)
  {
    Plane plane;
    args.Viewport.GetCameraFrame(out plane);

    Rectangle bounds = args.Viewport.Bounds;

    int width = 320;
    int height = 34;

    int distW = bounds.Width - width - 40;
    int distH = bounds.Height - height - 40;

    Color _color = ColorTranslator.FromHtml("#004187");

    args.Display.Draw2dRectangle(new Rectangle(distW, distH, width, height), Color.White, 0, Color.White);
    args.Display.Draw2dText("LEONBROHMANN.DE", Color.Black, new Point2d(distW + 4, distH + 7), false, 30);
  }
# ---------- end author ----------
panel = Panel(author)

elemsize = Slider(64, range=0..100)
height = Slider(38, range=0..100)

count = Slider(5, range=0..10)

# ----
# StartPt
pt = Point(Point(0, 0, 0))

# ----
# A simple circular tile pattern
panel_2 = Panel("Summary")

vec = VectorXYZ(XComponent=0, YComponent=expr("-x", elemsize), ZComponent=height)  # -> Vector, Length
vec_2 = VectorXYZ(XComponent=elemsize, YComponent=expr("-x", elemsize), ZComponent=0)  # -> Vector, Length
vec_3 = VectorXYZ(XComponent=0, YComponent=0, ZComponent=0)  # -> Vector, Length
vec_4 = VectorXYZ(XComponent=elemsize, YComponent=0, ZComponent=height)  # -> Vector, Length
merge = Merge(Data1=vec_3.Vector, Data2=vec_4.Vector, Data3=vec_2.Vector, Data4=vec.Vector)
move = Move(Geometry=pt, Motion=merge)  # -> Geometry, Transform

panel_3 = Panel("""1
3""")
bang = ExplodeTree(Data=graft(move.Geometry))  # -> Branch0, Branch1, Branch2, Branch3
item = ListItem(List=move.Geometry, Index=panel_3, Wrap=True)
cyl = Cylinder(Base=item, Radius=expr("x/2", elemsize), Length=-1000)
srf4pt = _4PointSurface(CornerA=bang.Branch0, CornerB=bang.Branch1, CornerC=bang.Branch2, CornerD=bang.Branch3)
splitmul = SplitBrepMultiple(Brep=srf4pt, Cutters=cyl)
item_2 = ListItem(List=splitmul, Index=0, Wrap=True)
edges = BrepEdges(Brep=item_2)  # -> Naked, Interior, NonManifold
panel_4 = Panel("""2
4""")
item_3 = ListItem(List=edges.Naked, Index=panel_4, Wrap=True)  # -> simplify(graft(Item))

panel_5 = Panel("""1
3""")
item_4 = ListItem(List=move.Geometry, Index=panel_5, Wrap=True)  # -> graft(Item)
Z = UnitZ(Factor=height)
move_2 = Move(Geometry=item_4, Motion=expr("-x", Z))  # -> simplify(Geometry), Transform
end = EndPoints(Curve=item_3)  # -> Start, End
merge_2 = Merge(Data1=move_2.Geometry, Data2=end.End)
merge_3 = Merge(Data1=move_2.Geometry, Data2=end.Start)
pline = PolyLine(Vertices=merge_3, Closed=False)
pline_2 = PolyLine(Vertices=merge_2, Closed=False)
edgesrf = EdgeSurface(CurveA=item_3, CurveB=pline, CurveC=pline_2)

multiplication = Multiplication(A=elemsize, B=count)
merge_4 = Merge(Data1=item_2, Data2=edgesrf)  # -> flatten(Result)
range = Range(Domain=multiplication, Steps=count)
join = BrepJoin(Breps=merge_4)  # -> Breps, Closed
X = UnitX(Factor=range)
move_3 = Move(Geometry=join.Breps, Motion=X)  # -> graft(Geometry), Transform
Y = UnitY(Factor=range)
move_4 = Move(Geometry=move_3.Geometry, Motion=expr("-x", Y))  # -> flatten(Geometry), Transform
data = Data(simplify(graft(move_4.Geometry)))
area = Area(Geometry=data)  # -> Area, simplify(Centroid)
lng = ListLength(List=flatten(area.Centroid))
random = Random(Range=Domain(0, 4), Number=lng, Seed=Slider(10, range=0..10), Integers=True)
multiplication_2 = Multiplication(A=random, B="90")  # -> simplify(graft(Result))
rotate = Rotate(Geometry=data, Angle=degrees(multiplication_2), Plane=area.Centroid)  # -> Geometry, Transform
edges_2 = BrepEdges(Brep=rotate.Geometry)  # -> flatten(Naked), flatten(Interior), NonManifold
preview = CustomPreview(Geometry=rotate.Geometry, Material=ColourSwatch(SwatchColor=RGB(176, 195, 217)))
c_colour = CSharpScript(width=4, color=RGB(0, 0, 0), crvs=[edges_2.Interior, edges_2.Naked])  # inputs width: Int32, color: Color, crvs: tree of Curve
# ---------- c_colour: C# usings ----------
using System.Drawing;
# ---------- c_colour: C# ----------
    _width = width;
    _color = color;
    _crvs = crvs.AllData(); // DataTree<Curve> to List<Curve>
# ---------- c_colour: C# additional code ----------
  List<Curve> _crvs = new List<Curve>();
  Color _color;
  int _width;

  //What does override do?
  //https://www.geeksforgeeks.org/c-sharp-method-overriding/
  public override void DrawViewportMeshes(IGH_PreviewArgs args)
  {
    //Is needed, to clear Geometry after the component is diabled
    if (this.Component.Locked)
      _crvs.Clear();

    for (int i = 0; i < _crvs.Count; i++)
    {
      Curve crv = _crvs[i];
      args.Display.DrawCurve(crv, _color, _width);
    }
  }
# ---------- end c_colour ----------
