# Grasshopper definition HexaTileGeneratorCSharp.gh (Grasshopper 1.0.7)

filletradius = Slider(0.6, range=0..1)
inneroffest = Slider(0.18, range=0..3)

author = CSharpScript()  # -> Output
# ---------- author: C# usings ----------
using System.IO;
using System.Linq;
using System.Data;
using System.Drawing;
using System.Reflection;
using System.Windows.Forms;
using System.Xml;
using System.Xml.Linq;
using System.Runtime.InteropServices;

using Rhino.DocObjects;
using Rhino.Collections;
using GH_IO;
using GH_IO.Serialization;
# ---------- author: C# ----------
    Output = new List<string>(){
        "Leon Brohmann",
        "Computational Designer",
        "leonbrohmann@gmx.de",
        "www.leonbrohmann.de"
        };
# ---------- author: C# additional code ----------
  //Draw all meshes in this method.
  public override void DrawViewportMeshes(IGH_PreviewArgs args)
  {
    Plane plane;
    args.Viewport.GetCameraFrame(out plane);

    Rectangle bounds = args.Viewport.Bounds;

    int width = 320;
    int height = 34;

    int distW = bounds.Width - width - 40;
    int distH = bounds.Height - height - 40;

    Color _color = ColorTranslator.FromHtml("#004187");

    args.Display.Draw2dRectangle(new Rectangle(distW, distH, width, height), Color.White, 0, Color.White);
    args.Display.Draw2dText("LEONBROHMANN.DE", Color.Black, new Point2d(distW + 4, distH + 7), false, 30);
  }
# ---------- end author ----------
panel = Panel(author)

height = Slider(0.5, range=0..1)

panel_2 = Panel("Summary")
panel_3 = Panel("A hexagon tile generator")

# ----
# 2D Polygon
xy = XYPlane(Origin=Point(0, 0, 0))
polygon = Polygon(Plane=xy, Radius=3, Segments=6, FilletRadius=0)  # -> Polygon, Length
rotate = Rotate(Geometry=polygon.Polygon, Angle=degrees(90), Plane=PlaneXY(0, 0, 0))  # -> Geometry, Transform

# ----
# 3D Tile
Z = UnitZ(Factor=height)
move = Move(Geometry=rotate.Geometry, Motion=Z)  # -> Geometry, Transform
offset = OffsetCurve(Curve=move.Geometry, Distance=expr("-x", inneroffest), Plane=PlaneXY(0, 0, 0), Corners=1)
rulesrf = RuledSurface(CurveA=rotate.Geometry, CurveB=offset)
cap = CapHoles(Brep=rulesrf)

explode = Explode(Curve=rotate.Geometry, Recursive=True)  # -> Segments, Vertices
item = ListItem(List=explode.Segments, Index=-1, Wrap=True)
item_2 = ListItem(List=explode.Segments, Index=0, Wrap=True)
eval = EvaluateCurve(Curve=reparameterize([item_2, item]), Parameter=0.5)  # -> Point, Tangent, Angle
end = EndPoints(Curve=item_2)  # -> Start, End
end_2 = EndPoints(Curve=item)  # -> Start, End
cp = ControlPoints(Curve=rotate.Geometry)  # -> Points, Weights, Knots
merge = Merge(Data1=end.End, Data2=eval.Point, Data3=end_2.Start, Data4=end_2.End)
item_3 = ListItem(List=cp.Points, Index=3, Wrap=True)
ln = Line(StartPoint=item_3, EndPoint=merge)  # -> graft(Line)
ext = ExtendCurve(Curve=ln, Type=0, Start=3, End=3)
pframe = PerpFrame(Curve=reparameterize(ext), Parameter=0)
orient = Orient(
    Geometry=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,
    Source=Plane(origin=(-2.305090609, -2.94583033, 0), x=(0, -1, 0), y=(1, 0, 0)),
    Target=pframe)  # -> graft(Geometry), Transform
swp1 = Sweep1(Rail=ext, Sections=orient.Geometry, Miter=1)  # -> flatten(Brep)
cap_2 = CapHoles(Brep=swp1)
panel_4 = Panel("""1
2""")
panel_5 = Panel("""1
2
4""")
move_2 = Move(Geometry=cap_2, Motion=Vector(0, 0, 0.3))  # -> flatten(Geometry), Transform
cull_i = CullIndex(List=move_2.Geometry, Indices=panel_5, Wrap=True)
cull_i_2 = CullIndex(List=move_2.Geometry, Indices=panel_4, Wrap=True)
sdiff = SolidDifference(BrepsA=cap, BrepsB=move_2.Geometry)
sdiff_2 = SolidDifference(BrepsA=cap, BrepsB=cull_i)
sdiff_3 = SolidDifference(BrepsA=cap, BrepsB=cull_i_2)

genes = GenePool(Decimals=0, Maximum=6, Minimum=0, Value=[3, 3])
genes_2 = GenePool(Decimals=0, Maximum=6, Minimum=0, Value=[0, 0])
rowucount = Slider(4, range=0..10)
rowvcount = Slider(8, range=0..10)
multiplication = Multiplication(A=genes, B="60")
multiplication_2 = Multiplication(A=genes_2, B="60")
startpoint = Point(Point(19.72290083, -11.86032401, 0))
c_tilepattern = CSharpScript(
    Tile=sdiff_2,
    StartPt=startpoint,
    RowUCount=rowucount,
    RowVCount=rowvcount,
    RotatePatternA=multiplication,
    RotatePatternB=multiplication_2)  # -> out, Tiles; inputs Tile: GeometryBase, StartPt: Point3d, RowUCount: Int32, RowVCount: Int32, RotatePatternA: list of Double, RotatePatternB: list of Double
# ---------- c_tilepattern: C# usings ----------
using System.Linq;
# ---------- c_tilepattern: C# ----------
    List<GeometryBase> tiles = new List<GeometryBase>();

    //Find Center of Hexagon
    BoundingBox hexaBox = Tile.GetBoundingBox(true);

    // Min Max of Bounding Box
    Point3d hexaMin = hexaBox.Min, hexaMax = hexaBox.Max;

    double width = hexaMax.X - hexaMin.X;
    double radians = Math.PI / 180 * 30;
    double heigth = Math.Cos(radians) * width;

    // Get translation Vector
    Vector3d moveStart = StartPt - hexaBox.Center;

    for (int v = 0; v < RowVCount; v++)
    {
      //Move If row is uneven - move element to tight
      double alignFac = IsOdd(v) ? width / 2 : 0;
      List<double> rotatePattern = IsOdd(v) ? RotatePatternB : RotatePatternA;

      int rotIdx = 0;

      for (int u = 0; u < RowUCount; u++)
      {
        //Create Copy

        GeometryBase tileCopy = Tile.Duplicate();

        //Move to Point
        Vector3d move = moveStart + new Vector3d(u * width + alignFac, -v * heigth, 0);
        tileCopy.Translate(move);

        //Get Rotation
        double rot = GetRotation(ref rotIdx, rotatePattern);
        tileCopy.Rotate(rot, Vector3d.ZAxis, hexaBox.Center + move);

        //Add to OutputList
        tiles.Add(tileCopy);
      }
    }

    //Outputs
    Tiles = tiles;
# ---------- c_tilepattern: C# additional code ----------
  public bool IsOdd(int val)
  {
    return val % 2 != 0;
  }

  public double GetRotation(ref int idx, List<double> list)
  {
    int count = list.Count;

    if (idx > count - 1)
      idx = 0;

    double val = Math.PI / 180 * list[idx];

    idx++;

    return val;
  }
# ---------- end c_tilepattern ----------

genes_3 = GenePool(Decimals=0, Maximum=6, Minimum=0, Value=[5, 1, 3])
genes_4 = GenePool(Decimals=0, Maximum=6, Minimum=0, Value=[3, 5, 1])
rowucount_2 = Slider(5, range=0..10)
rowvcount_2 = Slider(9, range=0..10)
multiplication_3 = Multiplication(A=genes_3, B="60")
multiplication_4 = Multiplication(A=genes_4, B="60")
startpoint_2 = Point(Point(-7.322325597, -11.86032401, 0))
c_tilepattern_2 = CSharpScript(
    Tile=sdiff,
    StartPt=startpoint_2,
    RowUCount=rowucount_2,
    RowVCount=rowvcount_2,
    RotatePatternA=multiplication_3,
    RotatePatternB=multiplication_4)  # -> out, Tiles; inputs Tile: GeometryBase, StartPt: Point3d, RowUCount: Int32, RowVCount: Int32, RotatePatternA: list of Double, RotatePatternB: list of Double; same code as c_tilepattern

genes_5 = GenePool(Decimals=0, Maximum=6, Minimum=0, Value=[4, 2, 3])
genes_6 = GenePool(Decimals=0, Maximum=6, Minimum=0, Value=[0, 5, 1])
rowucount_3 = Slider(7, range=0..10)
rowvcount_3 = Slider(7, range=0..10)
multiplication_5 = Multiplication(A=genes_5, B="60")
multiplication_6 = Multiplication(A=genes_6, B="60")
startpoint_3 = Point(Point(41.5387972, -11.86032401, 0))
c_tilepattern_3 = CSharpScript(
    Tile=sdiff_3,
    StartPt=startpoint_3,
    RowUCount=rowucount_3,
    RowVCount=rowvcount_3,
    RotatePatternA=multiplication_5,
    RotatePatternB=multiplication_6)  # -> out, Tiles; inputs Tile: GeometryBase, StartPt: Point3d, RowUCount: Int32, RowVCount: Int32, RotatePatternA: list of Double, RotatePatternB: list of Double; same code as c_tilepattern

number_slider = Slider(2, range=0..10)

# ----
# Viz
swatch = ColourSwatch(SwatchColor=RGB(181, 181, 181))
preview = CustomPreview(Geometry=c_tilepattern_2.Tiles, Material=swatch)

# ----
# Viz
swatch_2 = ColourSwatch(SwatchColor=RGB(222, 201, 98))
preview_2 = CustomPreview(Geometry=c_tilepattern.Tiles, Material=swatch_2)

# ----
# Viz
swatch_3 = ColourSwatch(SwatchColor=RGB(98, 222, 199))
preview_3 = CustomPreview(Geometry=c_tilepattern_3.Tiles, Material=swatch_3)
