# Grasshopper definition trianglesBetween2Curves.gh (Grasshopper 1.0.7)

author = CSharpScript()  # -> Output
# ---------- author: C# usings ----------
using System.IO;
using System.Linq;
using System.Data;
using System.Drawing;
using System.Reflection;
using System.Windows.Forms;
using System.Xml;
using System.Xml.Linq;
using System.Runtime.InteropServices;

using Rhino.DocObjects;
using Rhino.Collections;
using GH_IO;
using GH_IO.Serialization;
# ---------- author: C# ----------
    Output = new List<string>(){
        "Leon Brohmann",
        "Computational Designer",
        "leonbrohmann@gmx.de",
        "www.leonbrohmann.de"
        };
# ---------- author: C# additional code ----------
  //Draw all meshes in this method.
  public override void DrawViewportMeshes(IGH_PreviewArgs args)
  {
    Plane plane;
    args.Viewport.GetCameraFrame(out plane);

    Rectangle bounds = args.Viewport.Bounds;

    int width = 320;
    int height = 34;

    int distW = bounds.Width - width - 40;
    int distH = bounds.Height - height - 40;

    Color _color = ColorTranslator.FromHtml("#004187");

    args.Display.Draw2dRectangle(new Rectangle(distW, distH, width, height), Color.White, 0, Color.White);
    args.Display.Draw2dText("LEONBROHMANN.DE", Color.Black, new Point2d(distW + 4, distH + 7), false, 30);
  }
# ---------- end author ----------
panel = Panel(author)

# ----
# Crv1
# Crv2
# TrianglesBetweenCurves
crv = Curve(<curve referenced from the Rhino model>)
crv_2 = Curve(<curve referenced from the Rhino model>)
U = Slider(23, range=1..200)
V = Slider(6, range=1..10)
c_trianglesbetweencurves = CSharpScript(crv1=crv, crv2=crv_2, uDivision=U, vDivision=V)  # -> out, graft(All); inputs crv1: Curve, crv2: Curve, uDivision: Int32, vDivision: Int32
# ---------- c_trianglesbetweencurves: C# ----------
    //Get ControlPoints
    var cp1 = ((NurbsCurve) crv1).Points;
    var cp2 = ((NurbsCurve) crv2).Points;


    NurbsCurve[] nurbsCrvs = new NurbsCurve[vDivision + 1];

    double p = 1 / vDivision;
    int cpCount = cp1.Count();


    for (int u = 0; u < vDivision + 1; u++)
    {
      Point3d[] pts = new Point3d[cpCount];

      for (int i = 0; i < cpCount; i++)
      {
        Point3d vA = cp1[i].Location;
        Point3d vB = cp2[i].Location;
        Point3d pt = vA + (vB - vA) * u / vDivision;
        pts[i] = pt;
      }

      nurbsCrvs[u] = NurbsCurve.Create(false, 3, pts);
    }

    //-------------------------------------------
    //-----------------CreateParams----------------------
    //-------------------------------------------

    // Parameterraum ist 0-1
    double uLength = 1 / (double) uDivision;

    //Count of Points for each Row
    int aCount = uDivision + 2;
    int bCount = uDivision + 1;

    //RowA
    double[] paramA = new double[aCount];

    paramA[0] = 0;
    paramA[bCount] = 1;

    double halfLength = uLength / 2;

    for (int i = 0; i < uDivision ; i++)
      paramA[i + 1] = uLength * i + halfLength;

    //RowB

    double[] paramB = new double[bCount];

    for (int i = 0; i <= uDivision; i++)
      paramB[i] = uLength * i;

    //-------------------------------------------
    //Count Even Odd
    //-------------------------------------------

    int countVOdd = (vDivision + 1) / 2;
    int countVEven = ((vDivision + 1) % 2 == 0) ? countVOdd : countVOdd + 1;

    //-------------------------------------------
    //rowA
    //-------------------------------------------

    Point3d[] rowA = new Point3d[aCount * countVEven];

    int count = 0;

    //Anzahl der Reihen
    for (int v = 0; v < vDivision + 1; v += 2)
    {
      for (int u = 0; u < aCount; u++)
      {
        rowA[count] = nurbsCrvs[v].PointAt(paramA[u]);
        count++;
      }
    }

    //-------------------------------------------
    //rowB
    //-------------------------------------------

    Point3d[] rowB = new Point3d[bCount * countVOdd];

    count = 0;

    //Anzahl der Reihen
    for (int v = 1; v < vDivision + 1; v += 2)
    {
      for (int u = 0; u < bCount; u++)
      {
        rowB[count] = nurbsCrvs[v].PointAt(paramB[u]);
        count++;
      }
    }

    //-------------------------------------------
    //TriangleCount
    //-------------------------------------------

    int triangleEachRow = 2 * uDivision + 1;
    int triangleCount = triangleEachRow * vDivision;

    Polyline[] all = new Polyline[triangleCount];

    //-------------------------------------------
    //Triangle Up A
    //-------------------------------------------

    //Anzahl der Reihen
    for (int v = 0; v < countVOdd; v++)
    {
      int rowAIndex = v * aCount;
      int rowBIndex = v * bCount;

      int idx = ConstructIdx(v, triangleEachRow, 1);

      for (int u = 0; u < uDivision; u++)
      {
        int aIndex = rowAIndex + u;
        int bIndex = rowBIndex + u;

        ConstructTriangle(
          rowB[bIndex],
          rowA[aIndex + 1],
          rowB[bIndex + 1],
          ref all, u, idx);
      }
    }

    //-------------------------------------------
    //Triangle Down A
    //-------------------------------------------

    //Anzahl der Reihen
    for (int v = 0; v < countVOdd; v++)
    {
      int rowAIndex = v * aCount;
      int rowBIndex = v * bCount;

      int idx = ConstructIdx(v, triangleEachRow, 0);

      for (int u = 0; u < bCount; u++)
      {
        int aIndex = rowAIndex + u;
        int bIndex = rowBIndex + u;

        ConstructTriangle(
          rowA[aIndex],
          rowA[aIndex + 1],
          rowB[bIndex],
          ref all, u, idx);
      }
    }

    //-------------------------------------------
    //Triangle Down B
    //-------------------------------------------

    //Anzahl der Reihen
    for (int v = 0; v < countVEven - 1; v++)
    {
      int rowAIndex = (v + 1) * aCount;
      int rowBIndex = v * bCount;

      int idx = ConstructIdx(v, triangleEachRow, triangleEachRow + 1);

      for (int u = 0; u < uDivision; u++)
      {
        int aIndex = rowAIndex + u;
        int bIndex = rowBIndex + u;

        ConstructTriangle(
          rowB[bIndex],
          rowA[aIndex + 1],
          rowB[bIndex + 1],
          ref all, u, idx);
      }
    }

    //-------------------------------------------
    //Triangle Up B
    //-------------------------------------------

    //Anzahl der Reihen
    for (int v = 0; v < countVEven - 1; v++)
    {
      int rowAIndex = (v + 1) * aCount;
      int rowBIndex = v * bCount;

      int idx = ConstructIdx(v, triangleEachRow, triangleEachRow);

      for (int u = 0; u < bCount; u++)
      {
        int aIndex = rowAIndex + u;
        int bIndex = rowBIndex + u;

        ConstructTriangle(
          rowA[aIndex],
          rowA[aIndex + 1],
          rowB[bIndex],
          ref all, u, idx);
      }
    }

    //Output

    All = all;
# ---------- c_trianglesbetweencurves: C# additional code ----------
  private static int ConstructIdx(int v, int triangleEachRow, int modificator)
  {
    return modificator + (triangleEachRow * v * 2);
  }

  private void ConstructTriangle(Point3d a, Point3d b, Point3d c, ref Polyline[] all, int u, int idx)
  {
    all[idx + u * 2] = new Polyline() {a,b,c,a};
  }

  private Point3d[] GetRow(int rowCount, int vStart, int vCount, int uCount, double[] param, NurbsCurve[] nurbsCrvs)
  {
    Point3d[] row = new Point3d[rowCount];

    int count = 0;

    //Anzahl der Reihen
    for (int v = vStart; v < vCount; v += 2)
    {
      for (int u = 0; u < uCount; u++)
      {
        row[count] = nurbsCrvs[v].PointAt(param[u]);
        count++;
      }
    }

    return row;
  }
# ---------- end c_trianglesbetweencurves ----------

relay = Relay([crv, crv_2])

# ----
# A Script to generate a triangle Structure between two Curves
panel_2 = Panel("Summary")

panel_3 = Panel(c_trianglesbetweencurves.out)

# ----
# Color Curve
number_slider = Slider(10, range=0..10)
crv_3 = Curve(relay)
c_colour = CSharpScript(width=number_slider, color=ColourSwatch(SwatchColor=RGB(0, 0, 0)), crvs=crv_3)  # inputs width: Int32, color: Color, crvs: tree of Curve
# ---------- c_colour: C# usings ----------
using System.Drawing;
# ---------- c_colour: C# ----------
    _width = width;
    _color = color;
    _crvs = crvs.AllData(); // DataTree<Curve> to List<Curve>
# ---------- c_colour: C# additional code ----------
  List<Curve> _crvs = new List<Curve>();
  Color _color;
  int _width;

  //What does override do?
  //https://www.geeksforgeeks.org/c-sharp-method-overriding/
  public override void DrawViewportMeshes(IGH_PreviewArgs args)
  {
    //Is needed, to clear Geometry after the component is diabled
    if (this.Component.Locked)
      _crvs.Clear();

    for (int i = 0; i < _crvs.Count; i++)
    {
      Curve crv = _crvs[i];
      args.Display.DrawCurve(crv, _color, _width);
    }
  }
# ---------- end c_colour ----------

# ----
# Gradient Color Curve
tstat = TreeStatistics(Tree=c_trianglesbetweencurves.All)  # -> Paths, Length, Count
range = Range(Domain=Domain(0, 1), Steps=expr("x-1", tstat.Count))
gradient = Gradient(
    LowerLimit=0,
    UpperLimit=1,
    Parameter=range,
    stops=[0: RGB(243, 57, 0), 0.1: RGB(236, 27, 60), 0.2: RGB(210, 0, 118), 0.3: RGB(103, 0, 120), 0.4: RGB(39, 72, 161), 0.5: RGB(1, 192, 229), 0.6: RGB(18, 178, 90), 0.7: RGB(79, 186, 8), 0.8: RGB(220, 237, 32), 0.9: RGB(247, 159, 20), 1: RGB(243, 57, 0)])
c_colour_2 = CSharpScript(width=Slider(5, range=0..10), crvTree=c_trianglesbetweencurves.All, colors=gradient)  # inputs width: Int32, crvTree: tree of Curve, colors: list of Color
# ---------- c_colour_2: C# ----------
    _width = width;
    _colors = colors;
    _crvTree = crvTree;
# ---------- c_colour_2: C# additional code ----------
  List<Color> _colors;
  DataTree<Curve> _crvTree;
  int _width;

  public override void DrawViewportMeshes(IGH_PreviewArgs args)
  {
    //Is needed, to clear Geometry after the component is diabled
    if (this.Component.Locked)
      _crvTree.Clear();

    for (int u = 0; u < _crvTree.BranchCount; u++)
    {
      GH_Path pths = _crvTree.Paths[u];
      List<Curve> crvs = _crvTree.Branch(pths);

      Color color = _colors[u];

      for (int i = 0; i < crvs.Count; i++)
      {
        Curve crv = crvs[i];

        args.Display.DrawCurve(crv, color, _width);
      }
    }
  }
# ---------- end c_colour_2 ----------
