# Grasshopper definition rTreeCSharp.gh (Grasshopper 1.0.7)

author = CSharpScript()  # -> Output
# ---------- author: C# usings ----------
using System.IO;
using System.Linq;
using System.Data;
using System.Drawing;
using System.Reflection;
using System.Windows.Forms;
using System.Xml;
using System.Xml.Linq;
using System.Runtime.InteropServices;

using Rhino.DocObjects;
using Rhino.Collections;
using GH_IO;
using GH_IO.Serialization;
# ---------- author: C# ----------
    Output = new List<string>(){
        "Leon Brohmann",
        "Computational Designer",
        "leonbrohmann@gmx.de",
        "www.leonbrohmann.de"
        };
# ---------- author: C# additional code ----------
  //Draw all meshes in this method.
  public override void DrawViewportMeshes(IGH_PreviewArgs args)
  {
    Plane plane;
    args.Viewport.GetCameraFrame(out plane);

    Rectangle bounds = args.Viewport.Bounds;

    int width = 320;
    int height = 34;

    int distW = bounds.Width - width - 40;
    int distH = bounds.Height - height - 40;

    Color _color = ColorTranslator.FromHtml("#004187");

    args.Display.Draw2dRectangle(new Rectangle(distW, distH, width, height), Color.White, 0, Color.White);
    args.Display.Draw2dText("LEONBROHMANN.DE", Color.Black, new Point2d(distW + 4, distH + 7), false, 30);
  }
# ---------- end author ----------
panel = Panel(author)

# ----
# Geometry
number_slider = Slider(10000, range=0..100000)
box = DomainBox(Base=PlaneXY(0, 0, 0), X=Domain(0, 5), Y=Domain(0, 5), Z=Domain(0, 5))
pop3d = Populate3D(Region=box, Count=number_slider, Seed=1)

# ----
# Cylinder
cylinderradius = Slider(0.4, range=0..1)
pt = Point(Point(-1.804429326, 2.560504649, 1.721697885))
pt_2 = Point(Point(6.813442395, 0.8250375013, 3.353316377))
ln = Line(StartPoint=pt, EndPoint=pt_2)

# ----
# From the RhinoCommon:
# "RTree represents a spatial search structure based on implementations of the R-tree algorithm by Toni Gutman."
# 
# The example shows a simple distance calculation.
panel_2 = Panel("Summary")

# ----
# BoundingBox for rTree
blx = BrepLine(Brep=box, Line=ln, LimitToFirst=False)  # -> Curves, Points
c_script = CSharpScript(planes=blx.Points, radius=cylinderradius)  # -> out, BBox; inputs planes: list of Plane, radius: Double
# ---------- c_script: C# usings ----------
using System.Linq;
# ---------- c_script: C# ----------
    //CreateCornerBoxes
    Interval iVal = new Interval(-radius, radius);
    Box boxA = new Box(planes[0], iVal, iVal, iVal);
    Box boxB = new Box(planes[1], iVal, iVal, iVal);

    Point3d center = (boxA.Center + boxB.Center) / 2;

    Plane pln = new Plane(center, Vector3d.ZAxis);

    //Add Corner Points
    List<Point3d> pts = new List<Point3d>();

    pts.AddRange(boxA.GetCorners());
    pts.AddRange(boxB.GetCorners());

    //Add Max and Min point coordinate values using System.LINQ
    double x = (pts.Min(pt => pt.X) - pts.Max(pt => pt.X)) / 2;
    double y = (pts.Min(pt => pt.Y) - pts.Max(pt => pt.Y)) / 2;
    double z = (pts.Min(pt => pt.Z) - pts.Max(pt => pt.Z)) / 2;

    //Create Intervals for BoundingBox
    Interval xInvl = new Interval(-x, x);
    Interval yInvl = new Interval(-y, y);
    Interval zInvl = new Interval(-z, z);
    Box bound = new Box(pln, xInvl, yInvl, zInvl);

    BBox = bound;
# ---------- c_script: C# additional code ----------
  double CheckMin(double oldVal, double newVal)
  {
    if (newVal < oldVal)
      return newVal;

    return oldVal;
  }
# ---------- end c_script ----------

# ----
# What does the examples do?
# 
# The rTree C# component outputs all points (yellow) from a point collection located within a cylinder.
# 
# To speed up the distance calculation, a rTree is used. This allows us to reduce the search space by including a bounding box. (blue)
# 
# For more information visit the awesomewebsite of Luis Quinones:
# http://www.complicitmatter.com/PORTFOLIO/gallopingtopiary/
panel_3 = Panel("Explanation")

# ----
# Geometry.RTree
c_rtree = CSharpScript(box=c_script.BBox, line=ln, maxDistance=cylinderradius, pts=pop3d)  # -> out, InCylinder, OutCylinder; inputs box: Box, line: Line, maxDistance: Double, pts: list of Point3d
# ---------- c_rtree: C# ----------
    //https://developer.rhino3d.com/samples/rhinocommon/closest-point-calculation-with-rtree/

    RTree rTree = new RTree();

    int count = pts.Count;
    if (count == 0)
      throw new System.Exception("No Points!");

    // Fills RTree with Points
    for (int i = 0; i < count; i++)
    {
      Point3d pt = pts[i];
      rTree.Insert(pt, i);
    }

    //State to be passed inside the RTreeEventArgs Tag property.
    SearchData data = new SearchData(pts, line, maxDistance);

    // For safety reasons
    int breakCounter = 999999;

    while (true && breakCounter > 0)
    {
      if(rTree.Search(box.BoundingBox, SearchCallback, data))
        break;

      breakCounter--;
    }

    //Output
    InCylinder = data.InCylinder;
    OutCylinder = data.OutCylinder;
# ---------- c_rtree: C# additional code ----------
  //An event handler to be raised when items are found.
  static void SearchCallback(object sender, RTreeEventArgs e)
  {
    SearchData data = e.Tag as SearchData;
    if (data == null)
      return;
    data.HitCount = data.HitCount + 1;

    Line line = data.Ln;
    Point3d ptTest = data.Pts[e.Id];

    // Radius distance
    double distance = line.DistanceTo(ptTest, false);

    if (distance <= data.MaxDistance)
      data.InCylinder.Add(ptTest);
    else
      data.OutCylinder.Add(ptTest);
  }

  class SearchData
  {
    public SearchData(List<Point3d> pts, Line line, double maxDistance)
    {
      Ln = line;
      Pts = pts;
      HitCount = 0;
      MaxDistance = maxDistance;
      InCylinder = new List<Point3d>();
      OutCylinder = new List<Point3d>();
    }

    public int HitCount { get; set; }
    public Line Ln { get;  set; }
    public List<Point3d> Pts { get;  set; }
    public List<Point3d> InCylinder { get; set; }
    public List<Point3d> OutCylinder { get; set; }
    public double MaxDistance { get; set; }
  }
# ---------- end c_rtree ----------

# ----
# Visualisation
c_drw = CSharpScript(ptsA=c_rtree.InCylinder, ptsB=c_rtree.OutCylinder, ln=ln)  # inputs ptsA: list of Point3d, ptsB: list of Point3d, ln: Line
# ---------- c_drw: C# usings ----------
using System.Drawing;
using Rhino.Display;
# ---------- c_drw: C# ----------
    _ptsA = ptsA; // DataTree<Curve> to List<Curve>
    _ptsB = ptsB;
    _ln = ln;
# ---------- c_drw: C# additional code ----------
  List<Point3d> _ptsA = new List<Point3d>();
  List<Point3d> _ptsB = new List<Point3d>();
  Line _ln;

  //What does override do?
  //https://www.geeksforgeeks.org/c-sharp-method-overriding/
  public override void DrawViewportMeshes(IGH_PreviewArgs args)
  {
    //Is needed, to clear Geometry after the component is diabled
    if (this.Component.Locked)
    {
      _ptsA.Clear();
      _ptsB.Clear();
      _ln = Line.Unset;
    }

    args.Display.DrawPoints(_ptsA, (PointStyle) 4, 4, Color.Yellow);
    args.Display.DrawPoints(_ptsB, (PointStyle) 4, 2, Color.LightSkyBlue);
    args.Display.DrawPoint(_ln.From, PointStyle.X, 6, Color.Black);
    args.Display.DrawPoint(_ln.To, PointStyle.X, 6, Color.Black);
    args.Display.DrawLine(_ln, Color.Black, 4);
  }
# ---------- end c_drw ----------
edges = BrepEdges(Brep=c_script.BBox)  # -> Naked, Interior, NonManifold
c_drawpts = CSharpScript(radius=1, color=RGB(158, 158, 158), pts=pop3d, ptStyle="0")  # inputs radius: Int32, color: Color, pts: tree of Point3d, ptStyle: Int32
# ---------- c_drawpts: C# ----------
    _radius = radius;
    _color = color;
    _pts = pts.AllData(); // DataTree<Curve> to List<Curve>
    _ptStyle = (PointStyle) ptStyle; //Explicit Type Conversion - See https://www.programiz.com/csharp-programming/type-conversion
# ---------- c_drawpts: C# additional code ----------
  List<Point3d> _pts = new List<Point3d>();
  Color _color;
  int _radius;
  PointStyle _ptStyle;

  //What does override do?
  //https://www.geeksforgeeks.org/c-sharp-method-overriding/
  public override void DrawViewportMeshes(IGH_PreviewArgs args)
  {
    //Is needed, to clear Geometry after the component is diabled
    if (this.Component.Locked)
      _pts.Clear();

    args.Display.DrawPoints(_pts, _ptStyle, _radius, _color);
  }
# ---------- end c_drawpts ----------
c_colour = CSharpScript(width=4, color=RGB(51, 139, 255), crvs=edges.Interior)  # inputs width: Int32, color: Color, crvs: tree of Curve
# ---------- c_colour: C# usings ----------
using System.Drawing;
# ---------- c_colour: C# ----------
    _width = width;
    _color = color;
    _crvs = crvs.AllData(); // DataTree<Curve> to List<Curve>
# ---------- c_colour: C# additional code ----------
  List<Curve> _crvs = new List<Curve>();
  Color _color;
  int _width;

  //What does override do?
  //https://www.geeksforgeeks.org/c-sharp-method-overriding/
  public override void DrawViewportMeshes(IGH_PreviewArgs args)
  {
    //Is needed, to clear Geometry after the component is diabled
    if (this.Component.Locked)
      _crvs.Clear();

    for (int i = 0; i < _crvs.Count; i++)
    {
      Curve crv = _crvs[i];
      args.Display.DrawCurve(crv, _color, _width);
    }
  }
# ---------- end c_colour ----------

# ----
# https://en.wikipedia.org/wiki/R-tree
# 
# https://developer.rhino3d.com/api/RhinoCommon/html/T_Rhino_Geometry_RTree.htm
# 
# https://developer.rhino3d.com/samples/rhinocommon/closest-point-calculation-with-rtree/
panel_4 = Panel("Links")
