# Grasshopper definition SwapSurfaceUV.gh (Grasshopper 1.0.7)

author = CSharpScript()  # -> Output
# ---------- author: C# usings ----------
using System.IO;
using System.Linq;
using System.Data;
using System.Drawing;
using System.Reflection;
using System.Windows.Forms;
using System.Xml;
using System.Xml.Linq;
using System.Runtime.InteropServices;

using Rhino.DocObjects;
using Rhino.Collections;
using GH_IO;
using GH_IO.Serialization;
# ---------- author: C# ----------
    Output = new List<string>(){
        "Leon Brohmann",
        "Computational Designer",
        "leonbrohmann@gmx.de",
        "www.leonbrohmann.de"
        };
# ---------- author: C# additional code ----------
  //Draw all meshes in this method.
  public override void DrawViewportMeshes(IGH_PreviewArgs args)
  {
    Plane plane;
    args.Viewport.GetCameraFrame(out plane);

    Rectangle bounds = args.Viewport.Bounds;

    int width = 320;
    int height = 34;

    int distW = bounds.Width - width - 40;
    int distH = bounds.Height - height - 40;

    Color _color = ColorTranslator.FromHtml("#004187");

    args.Display.Draw2dRectangle(new Rectangle(distW, distH, width, height), Color.White, 0, Color.White);
    args.Display.Draw2dText("LEONBROHMANN.DE", Color.Black, new Point2d(distW + 4, distH + 7), false, 30);
  }
# ---------- end author ----------
panel = Panel(author)

# ----
# Transpose & Reverse Surface
transpose_swapuv = BooleanToggle(True)
reverse_u_domain = BooleanToggle(False)
reverse_v_domain = BooleanToggle(False)
srf = Surface(reparameterize(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))
c_script = CSharpScript(Srf=srf, Transpose=transpose_swapuv, ReverseU=reverse_u_domain, ReverseV=reverse_v_domain)  # -> out, UDom, VDom, A; inputs Srf: Surface, Transpose: Boolean, ReverseU: Boolean, ReverseV: Boolean
# ---------- c_script: C# ----------
    if(Transpose)
      Srf.Transpose(true);

    if (ReverseU)
      Srf.Reverse(0, true);

    if (ReverseV)
      Srf.Reverse(1, true);

    //Output
    A = Srf;
    UDom = Srf.Domain(0);
    VDom = Srf.Domain(1);
# ---------- end c_script ----------
panel_2 = Panel(c_script.UDom)
panel_3 = Panel(c_script.VDom)

# ----
# Swap/ Flip and REverse UV Domains of a Surface in C#.
panel_4 = Panel("Explanation")

# ----
# Visualisation
panel_5 = Panel("3")
sframes = SurfaceFrames(Surface=c_script.A, UCount=panel_5, VCount="5")  # -> Frames, Parameters
range = Range(Domain=Domain(14, 23), Steps=expr("x+1", panel_5))  # -> graft(Range)
series = Series(Start=10, Step=20, Count=expr("x+1", "5"))
c_script_2 = CSharpScript(Srf=c_script.A, pts=flatten(sframes.Frames))  # inputs Srf: Surface, pts: list of Point3d
# ---------- c_script_2: C# usings ----------
  using  System.Drawing;
# ---------- c_script_2: C# ----------
    _pts = pts;
    _srf = Srf;
# ---------- c_script_2: C# additional code ----------
  List<Point3d> _pts;
  Surface _srf;

  //Draw all meshes in this method.
  public override void DrawViewportMeshes(IGH_PreviewArgs args)
  {
    int digits = 2;
    
    for (int i = 0; i < _pts.Count; i++)
    {
      Point3d pt = _pts[i];

      double u,v;
      _srf.ClosestPoint(pt, out u, out v);
      
      u = Math.Round(u, digits);
      v = Math.Round(v, digits);
      
      args.Display.Draw2dText("[" + u + " ; " + v + "]", Color.Black, pt, true, 25);
    }
  }
# ---------- end c_script_2 ----------
cyl = Cylinder(Base=sframes.Frames, Radius=range, Length=series)
cap = CapHoles(Brep=cyl)
preview = CustomPreview(
    Geometry=[cap, c_script.A],
    Material={diffuse=RGB(247, 255, 0), emission=RGB(74, 76, 0), shine=0.5, specular=RGB(255, 255, 255), transparency=0})
