# Grasshopper definition Threads_ContinuousLoop.gh (Grasshopper 1.0.7)

# ----
# System.Threading
reset = Button()
start = BooleanToggle(False)
c_thread = CSharpScript(reset=reset, start=start)  # -> out, RndPts, ThrdStatus; inputs reset: Boolean, start: Boolean
# ---------- c_thread: C# usings ----------
using System.Threading;
# ---------- c_thread: C# ----------
    // Reset to the initial state
    if (reset)
    {
      Reset();
      return;
    }

    Status status = GetThreadStatus();

    //Starts, Stops or do nothing - START
    if (start && status == Status.NotInitialized)
      Start();
    else if (!start && status == Status.Started)
      Stop();
   
    //Output
    ThrdStatus = GetThreadStatus();
    
    //points needs to be locked to be threadsafe
    lock (points)
      RndPts = points;
# ---------- c_thread: C# additional code ----------
  static Thread workerThread;
  static List<Point3d> points = new List<Point3d> (){Point3d.Origin};
  
  enum Status
  {
    NotInitialized,
    Started,
    Stopped
  }

  // event/delegate
  static event Notify OnLoopEnd; 
  delegate void Notify();
  
  //Important for the ModifyPtList method
  Random rndm = new Random();
  static bool revert = false;

  //The Methid, which is called from the working thread
  void ModifyPtList()
  {
    //Infinite Loop
    while (true) 
    {
      // DO something - START
      double x = rndm.Next(0, 11);
      double y = rndm.Next(0, 11);
      double z = rndm.Next(0, 11);

      Point3d pt = new Point3d(x, y, z);

      //Important to lock Points to be thread safe
      lock (points)
      {
        int count = points.Count;
        if (count > 30)
          revert = true;
        else if(count == 1)
          revert = false;

        if (revert)
          points.RemoveAt(0);
        else
          points.Add(pt);
      }

      // DO something - END
      
      // Invoke the Event at the End of the Loop
      OnLoopEnd.Invoke();
       // Thread Sleep pauses the thread for some miliseconds - if deleted - rhino can crash easily
      Thread.Sleep(10);
    }
  }

  //Returns the current Status of the Thread
  Status GetThreadStatus()
  {
    if (workerThread == null)
      return Status.NotInitialized;
    else if (workerThread.IsAlive)
      return Status.Started;
    else
      return Status.Stopped;
  }

  //Creates a Thread and STarts it
  void Start()
  {
    OnLoopEnd += ExpireSolution; // The event is used to tell the Grasshoppercomponent tu restart
    workerThread = new  Thread(ModifyPtList);
    workerThread.Start();
  }

  // Deletes all Points and Stop the Thread
  void Reset()
  {
    points.Clear();
    points.Add(Point3d.Origin);
    Stop();
  }

  //Stops the Thread
  void Stop()
  {
    // Unsubscribe the delegate from the event
    OnLoopEnd = null;

    if (workerThread != null && workerThread.IsAlive)
      workerThread.Abort();

    workerThread = null;
  }

  // Is called to recalculate the component
  void ExpireSolution()
  {
    // Credit: David Rutten, Eric Anastas
    // https://www.grasshopper3d.com/forum/topics/triggering-solution-refresh?overrideMobileRedirect=1&id=2985220%3ATopic%3A170034&page=1
    var expireAction = new Action<bool>(this.Component.ExpireSolution);

    Grasshopper.Instances.ActiveCanvas.Invoke(expireAction, new object[] { true });
    //The Action has to be invoked, because this method is called by the worker thread and not the mainthread
  }
# ---------- end c_thread ----------
panel = Panel(c_thread.ThrdStatus)
data = Panel(c_thread.RndPts)

author = CSharpScript()  # -> Output
# ---------- author: C# usings ----------
using System.IO;
using System.Linq;
using System.Data;
using System.Drawing;
using System.Reflection;
using System.Windows.Forms;
using System.Xml;
using System.Xml.Linq;
using System.Runtime.InteropServices;

using Rhino.DocObjects;
using Rhino.Collections;
using GH_IO;
using GH_IO.Serialization;
# ---------- author: C# ----------
    Output = new List<string>(){
        "Leon Brohmann",
        "Computational Designer",
        "leonbrohmann@gmx.de",
        "www.leonbrohmann.de"
        };
# ---------- author: C# additional code ----------
  //Draw all meshes in this method.
  public override void DrawViewportMeshes(IGH_PreviewArgs args)
  {
    Plane plane;
    args.Viewport.GetCameraFrame(out plane);

    Rectangle bounds = args.Viewport.Bounds;

    int width = 320;
    int height = 34;

    int distW = bounds.Width - width - 40;
    int distH = bounds.Height - height - 40;

    Color _color = ColorTranslator.FromHtml("#004187");

    args.Display.Draw2dRectangle(new Rectangle(distW, distH, width, height), Color.White, 0, Color.White);
    args.Display.Draw2dText("LEONBROHMANN.DE", Color.Black, new Point2d(distW + 4, distH + 7), false, 30);
  }
# ---------- end author ----------
panel_2 = Panel(author)

# ----
# The Grasshopper script shows an example how to deal with threads in the C# Script Editor.
panel_3 = Panel("Explanation")

# ----
# A thread gets initialiazed and started. The Thread executing a method, which fills during a never ending while loop a static Point3d list with random entities. After 40 added Points, the get removed one by one.
# 
# When the component is stopped (start == false), the current thread is aborted and through an event delegate - the component will recalculate.
panel_4 = Panel("Summary")

# ----
# Voronoi
voronoi³ = Voronoi3D(Points=c_thread.RndPts, Box={Plane=PlaneXY(5, 5, 5), X=Domain(-5, 5), Y=Domain(-5, 5), Z=Domain(-5, 5)})  # -> Cells, Boundary
edges = BrepEdges(Brep=voronoi³.Cells)  # -> Naked, Interior, NonManifold

# ----
# https://www.tutorialspoint.com/csharp/csharp_multithreading.htm
# https://www.geeksforgeeks.org/c-sharp-multithreading/
# Why Thread safety is important
# https://www.c-sharpcorner.com/UploadFile/1c8574/thread-safety369/
# Threaded vs. Non-Threaded applications
# Why you have to invoke the ExpireSolution Method, rather then calling it inside the thread:
# 
# https://www.grasshopper3d.com/forum/topics/triggering-solution-refresh?overrideMobileRedirect=1&id=2985220%3ATopic%3A170034&page=1
# 
# Credit to: David Rutten, Eric Anastas
panel_5 = Panel("What is a thread?")
panel_6 = Panel("Why Multithreading?")

# ----
# Visualisation
tstat = TreeStatistics(Tree=edges.Interior)  # -> Paths, Length, Count
range = Range(Domain=tstat.Count, Steps=expr("x-1", tstat.Count))
gradient = Gradient(
    LowerLimit=tstat.Count,
    UpperLimit=1,
    Parameter=range,
    stops=[0: RGB(234, 38, 0), 0.0473: RGB(234, 126, 0), 0.15: RGB(254, 244, 84), 0.301: RGB(173, 203, 249), 1: RGB(75, 107, 169)])
c_colour = CSharpScript(width=Slider(6, range=0..10), crvTree=edges.Interior, colors=gradient)  # inputs width: Int32, crvTree: tree of Curve, colors: list of Color
# ---------- c_colour: C# usings ----------
using System.Drawing;
# ---------- c_colour: C# ----------
    _width = width;
    _colors = colors;
    _crvTree = crvTree;
# ---------- c_colour: C# additional code ----------
  List<Color> _colors;
  DataTree<Curve> _crvTree;
  int _width;

  public override void DrawViewportMeshes(IGH_PreviewArgs args)
  {
    if (_crvTree.BranchCount <= 1)     // Solves an ArgumentOutOfRangeException in the display pipeline
      return;

    for (int u = 0; u < _crvTree.BranchCount; u++)
    {
      GH_Path pths = _crvTree.Paths[u];
      List<Curve> crvs = _crvTree.Branch(pths);

      Color color = _colors[u];

      for (int i = 0; i < crvs.Count; i++)
      {
        Curve crv = crvs[i];

        args.Display.DrawCurve(crv, color, _width);
      }
    }
  }
# ---------- end c_colour ----------
