# Grasshopper definition Unflatten_CSharp.gh (Grasshopper 1.0.7)

author = CSharpScript()  # -> Output
# ---------- author: C# usings ----------
using System.IO;
using System.Linq;
using System.Data;
using System.Drawing;
using System.Reflection;
using System.Windows.Forms;
using System.Xml;
using System.Xml.Linq;
using System.Runtime.InteropServices;

using Rhino.DocObjects;
using Rhino.Collections;
using GH_IO;
using GH_IO.Serialization;
# ---------- author: C# ----------
    Output = new List<string>(){
        "Leon Brohmann",
        "Computational Designer",
        "leonbrohmann@gmx.de",
        "www.leonbrohmann.de"
        };
# ---------- author: C# additional code ----------
  //Draw all meshes in this method.
  public override void DrawViewportMeshes(IGH_PreviewArgs args)
  {
    Plane plane;
    args.Viewport.GetCameraFrame(out plane);

    Rectangle bounds = args.Viewport.Bounds;

    int width = 320;
    int height = 34;

    int distW = bounds.Width - width - 40;
    int distH = bounds.Height - height - 40;

    Color _color = ColorTranslator.FromHtml("#004187");

    args.Display.Draw2dRectangle(new Rectangle(distW, distH, width, height), Color.White, 0, Color.White);
    args.Display.Draw2dText("LEONBROHMANN.DE", Color.Black, new Point2d(distW + 4, distH + 7), false, 30);
  }
# ---------- end author ----------
panel = Panel(author)

pt = Point(Tree({2}: [Point(0.960044973, 9.516898365, 0.9651758973), Point(0.05782672672, 8.562761121, 0.8057724567)], {6}: [Point(0.2311500303, 5.332512602, 0.4653467547)], {7}: [Point(6.131540014, 3.183633179, 0.8086947691), Point(8.160089985, 4.635271875, 0.5524828269), Point(8.511162898, 4.838366441, 1.349331619)], {8}: [Point(6.327645432, 9.723948846, 1.073478967)], {10}: [Point(4.155325952, 9.551214147, 0.09266022597)], {14}: [Point(0.03746482545, 2.681374626, 0.790803552), Point(2.569421154, 2.796612169, 1.396575004)]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))
pt_2 = Point(Tree({2}: [Point(0.960044973, 9.516898365, 0.9651758973), Point(0.05782672672, 8.562761121, 0.8057724567)], {6}: [Point(0.2311500303, 5.332512602, 0.4653467547)], {7}: [Point(6.131540014, 3.183633179, 0.8086947691), Point(8.160089985, 4.635271875, 0.5524828269), Point(8.511162898, 4.838366441, 1.349331619)], {8}: [Point(6.327645432, 9.723948846, 1.073478967)], {10}: [Point(4.155325952, 9.551214147, 0.09266022597)], {14}: [Point(0.03746482545, 2.681374626, 0.790803552), Point(2.569421154, 2.796612169, 1.396575004)]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))
flatten = FlattenTree(Tree=pt, Path="{0}")
viewer = ParamViewer(pt)
flatten_2 = FlattenTree(Tree=pt_2, Path="{0}")
viewer_2 = ParamViewer(pt_2)

# ----
# https://www.leonbrohmann.de/2022/06/24/gh-snippets-unflatten-as-a-c-component/
panel_2 = Panel("Link")

unflattentreec = CSharpScript(list=flatten, tree=pt)  # -> out, A; inputs list: list, tree: tree
# ---------- unflattentreec: C# ----------
    List<GH_Path> paths = new List<GH_Path>();

    // Iterates through every Branch and adds for every element in it the fitting adress to a pathlist.
    for (int p = 0; p < tree.Paths.Count; p++)
    {
      GH_Path pth = tree.Path(p);
      List<object> lst = tree.Branch(pth);

      for (int i = 0; i < lst.Count; i++)
        paths.Add(pth);
    }

    //The new datetree structure gets filled with the elements from the original list and the pathlist
    DataTree<object> newTree = new DataTree<object>();

    for (int i = 0; i < list.Count; i++)
      newTree.Add(list[i], paths[i]);

    A = newTree;
# ---------- end unflattentreec ----------
# Unflatten Component in C#
viewer_3 = ParamViewer(flatten)
unflatten = UnflattenTree(Tree=flatten_2, Guide=pt_2)
# Unflatten Component
viewer_4 = ParamViewer(flatten_2)

# ----
# You need the unflatten function of the unflatten component to write your own unflatten componenent in c#? I have something for you! You are welcome! But why? You may ask… Because it was late and i forgot, that there is a unflatten component in Grasshopper. Enjoy!
panel_3 = Panel("Summary")

panel_4 = Panel(unflattentreec.A)
viewer_5 = ParamViewer(unflattentreec.A)
panel_5 = Panel(unflatten)
viewer_6 = ParamViewer(unflatten)
